# Grasshopper definition 2-4-2021.gh (Grasshopper 1.0.7)

number_slider = Slider(20, range=0..100)
point = Point(<point referenced from the Rhino model>)
unit_x = UnitX(Factor=Slider(210, range=0..1000))
point_2 = Point(<point referenced from the Rhino model>)
rectangle = Rectangle(Plane=point, XSize=Slider(30, range=0..100), YSize=number_slider, Radius=0)  # -> Rectangle, Length
number_slider_2 = Slider(3, range=0..10)
move = Move(Geometry=point, Motion=unit_x)  # -> Geometry, Transform
rectangle_2 = Rectangle(Plane=point_2, XSize=Slider(210, range=0..1000), YSize=Slider(20, range=0..100), Radius=0)  # -> Rectangle, Length
unit_z = UnitZ(Factor=Slider(45, range=0..100))
unit_x_2 = UnitX(Factor=number_slider)
line = Line(StartPoint=point, EndPoint=move.Geometry)
domain_box = DomainBox(Base=point, X=number_slider_2, Y=number_slider_2, Z=number_slider_2)
extrude = Extrude(Base=rectangle_2.Rectangle, Direction=unit_z)
cap_holes = CapHoles(Brep=extrude)
box_array = BoxArray(
    Geometry=domain_box,
    Cell=domain_box,
    XCount=Slider(70, range=0..100),
    YCount=Slider(1, range=0..100),
    ZCount=Slider(20, range=0..100))  # -> Geometry, Transform
linear_array = LinearArray(Geometry=rectangle.Rectangle, Direction=unit_x_2, Count=Slider(10, range=0..10))  # -> Geometry, Transform
volume = Volume(Geometry=cap_holes)  # -> Volume, Centroid
volume_2 = Volume(Geometry=box_array.Geometry)  # -> Volume, Centroid
panel = Panel(volume.Volume)
merge = Merge(
    Data1=Slider(15, range=1..15, expression="X*3"),
    Data2=Slider(15, range=1..15, expression="X*3"),
    Data3=Slider(15, range=1..15, expression="X*3"),
    Data4=Slider(12, range=1..15, expression="X*3"),
    Data5=Slider(15, range=1..15, expression="X*3"),
    Data6=Slider(9, range=1..15, expression="X*3"),
    Data7=Slider(14, range=1..15, expression="X*3"),
    Data8=Slider(8, range=1..15, expression="X*3"),
    Data9=Slider(6, range=1..15, expression="X*3"),
    Data10=Slider(15, range=1..15, expression="X*3"))
geometry = Geometry(volume_2.Centroid)
unit_z_2 = UnitZ(Factor=merge)
extrude_2 = Extrude(Base=graft(linear_array.Geometry), Direction=graft(unit_z_2))  # disabled
cap_holes_2 = CapHoles(Brep=extrude_2)
custom_preview = CustomPreview(Geometry=cap_holes_2, Material=ColourSwatch(SwatchColor=RGB(255, 255, 255)))
