# Grasshopper definition 25-02-2021.gh (Grasshopper 1.0.7)

# ----
# Gardens
# Option_two
# Option_one
# Option_four
# Option_three
# Option_six
# Option_five
# Option_eight
# Option_nine
# Option_eleven
# Option_seven
# Option_ten
brep = Brep([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])
brep_2 = Brep([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])
brep_3 = Brep([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])
brep_4 = Brep([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])
brep_5 = Brep([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])
brep_6 = Brep(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)
brep_7 = Brep([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])
brep_8 = Brep([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])
brep_9 = Brep([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])
brep_10 = Brep([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])
brep_11 = Brep([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])

# ----
# Massing Options
# Option_one
# Option_two
# Option_six
# Option_four
# Option_five
# Option_three
# Option_ten
# Option_nine
# Option_eleven
# Option_eight
# Option_seven
brep_12 = Brep([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])
brep_13 = Brep([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])
brep_14 = Brep([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])
brep_15 = Brep([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])
brep_16 = Brep([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])
brep_17 = Brep([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])
brep_18 = Brep([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])
brep_19 = Brep([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])
brep_20 = Brep([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])
brep_21 = Brep([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])
brep_22 = Brep([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])

curve = Curve(<curve referenced from the Rhino model>)  # disabled
skydome = LBSkyDome()  # -> report, mesh, compass, legend, title, patch_vecs, patch_values, mesh_values; plug-in component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
dimensions = Dimensions(Surface=curve)  # -> UDimension, VDimension; disabled
area = Area(Geometry=curve)  # -> Area, Centroid; disabled
epwmap = LBEPWmap(epw_map=Toggle(True))  # -> report; plug-in component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
number_slider = Slider(3, range=0..10)  # disabled
brep_23 = Brep(<brep referenced from the Rhino model>)  # disabled
panel = Panel("https://www.energyplus.net/weather-download/europe_wmo_region_6/NLD//NLD_Amsterdam.062400_IWEC/all")
downloadepw = LBDownloadWeather(weather_URL=panel)  # -> epw_file, stat_file, ddy_file; plug-in component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
mesh = Mesh(brep_23)  # disabled
division = Division(A=dimensions.UDimension, B=number_slider)  # disabled
division_2 = Division(A=dimensions.VDimension, B=number_slider)  # disabled
panel_2 = Panel(dimensions.VDimension)  # disabled
square = Square(Plane=PlaneXY(2.597754939, -337.4971025, 0), Size=number_slider, ExtentX=division_2, ExtentY=division)  # -> Cells, Points; disabled
importepw = LBImportEPW(epw_file=downloadepw.epw_file)  # -> location, dry_bulb_temperature, dew_point_temperature, relative_humidity, wind_speed, wind_direction, direct_normal_rad, diffuse_horizontal_rad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; plug-in component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
explode = Explode(Curve=square.Cells, Recursive=True)  # -> Segments, Vertices; disabled
vector_2pt = Vector2Pt(PointA=Point(-592.3114903, -235.3755788, 0), PointB=Point(-648.4559105, -199.5409801, 0), Unitize=False)  # -> Vector, Length
panel_3 = Panel("1")  # disabled
series = Series(Start="1", Step=1, Count="12")
series_2 = Series(Start="7", Step=1, Count="9")
boolean_toggle = BooleanToggle(True)
point = Point(Point(149.4275346, -436.3937473, 0))
list_item = ListItem(List=explode.Vertices, Index=panel_3, Wrap=True)  # -> flatten(Item); disabled
curve_2 = Curve([<curve referenced from the Rhino model> x3])  # disabled
panel_4 = Panel(list_item)  # disabled
hoy = LBCalculateHOY(month=graft(series), hour=series_2)  # -> flatten(hoy), flatten(doy), flatten(date); plug-in component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
point_in_curves = PointInCurves(Point=list_item, Curves=curve_2)  # -> Relationship, Index, Point; disabled
cull_pattern = CullPattern(List=list_item, CullPattern=invert(point_in_curves.Relationship))  # disabled
weight_for_ij = Slider(7, range=0..10)
weight_for_road = Slider(5, range=0..10)
sunpath = LBSunPath(north=vector_2pt.Vector, location=importepw.location, hoys=hoy.hoy, center_pt=point, scale=1)  # -> report, vectors, altitudes, azimuths, hoys, sun_pts, analemma, daily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; plug-in component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
weight_for_kop_grasweg = Slider(3, range=0..10)
number_slider_2 = Slider(10, range=0..10)
cop_grasweg_bridge = Point(<point referenced from the Rhino model>)
ij_points = Curve(<curve referenced from the Rhino model>)
road_points = Curve(<curve referenced from the Rhino model>)
brep_24 = Brep([<brep referenced from the Rhino model> x22])
divide_distance = DivideDistance(Curve=road_points, Distance=number_slider_2)  # -> Points, Tangents, Parameters
list_length = ListLength(List=divide_distance.Points)
divide_distance_2 = DivideDistance(Curve=ij_points, Distance=number_slider_2)  # -> Points, Tangents, Parameters
list_length_2 = ListLength(List=divide_distance_2.Points)
duplicate_data = DuplicateData(Data=weight_for_ij, Number=list_length_2, Order=True)
duplicate_data_2 = DuplicateData(Data=weight_for_road, Number=list_length, Order=True)
option_one = Panel("2696871")
geometry_option_one = Brep([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])  # disabled
merge = Merge(Data1=weight_for_kop_grasweg, Data2=duplicate_data, Data3=duplicate_data_2)  # -> flatten(Result)
geometry = Geometry(divide_distance_2.Points)
# SUN HOURS
# RADIATION ( FOR ENERGY)
# VISIBILITY
# ACCESS TO SKY(GARDENS)
# PRIVACY
# BUILT AREA / SUN HOURS
unit_z = UnitZ(Factor=1)
merge_2 = Merge(Data1=cop_grasweg_bridge, Data2=divide_distance_2.Points, Data3=divide_distance.Points)  # -> flatten(Result)
option_two = Panel("2920563")
brep_25 = Brep([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])
context = Brep([<brep referenced from the Rhino model> x15])
number_slider_3 = Slider(1, range=0..1)
number_slider_4 = Slider(0.01, range=0..0.01)
brep_26 = Brep([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])  # disabled
geo_block = BooleanToggle(True)
panel_5 = Panel(brep_25)
run_it = BooleanToggle(True)
colour_swatch = ColourSwatch(SwatchColor=RGB(255, 255, 255))
brep_27 = Brep([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])
boolean_toggle_2 = BooleanToggle(True)
option_three = Panel("3132236")
list_length_3 = ListLength(List=brep_25)
point_2 = Point(<point referenced from the Rhino model>)
move = Move(Geometry=point_2, Motion=unit_z)  # -> Geometry, Transform
vector_2pt_2 = Vector2Pt(PointA=point_2, PointB=move.Geometry, Unitize=False)  # -> Vector, Length
# Direct_sunlight_hours
brep_28 = Brep([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])  # disabled
series_3 = Series(Start=0, Step=1, Count=list_length_3)
create_material = CreateMaterial(Diffuse=colour_swatch, Specular=colour_swatch, Emission=RGB(0, 0, 0), Transparency=Slider(0.5, range=0..1), Shine=0)
multiplication = Multiplication(A=series_3, B=4)
panel_6 = Panel(multiplication)
duplicate_data_3 = DuplicateData(Data=brep_25, Number=list_length_3, Order=True)
option_four = Panel("3061037")
visibilitypercent = LBVisibilityPercent(
    view_points=merge_2,
    pt_weights=merge,
    geometry=flatten(brep_25),
    context=flatten(context),
    grid_size=number_slider_3,
    offset_dist=number_slider_4,
    geo_block=geo_block,
    run=run_it)  # -> report, points, flatten(results), mesh, legend, title, int_mtx; plug-in component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
contour = Contour(Shape=flatten(brep_25), Point=point_2, Direction=vector_2pt_2.Vector, Distance=Slider(3, range=0..10))
viewpercent = LBViewPercent(
    view_type=Slider(3, range=0..10),
    geometry=flatten(brep_27),
    context=flatten(brep_25),
    grid_size=number_slider_3,
    offset_dist=number_slider_4,
    geo_block=boolean_toggle_2,
    parallel=boolean_toggle_2,
    run=boolean_toggle_2)  # -> out, points, view_vecs, results, mesh, legend, title, int_mtx; plug-in component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
brep_29 = Brep([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])  # disabled
cull_index = CullIndex(List=duplicate_data_3, Indices=multiplication, Wrap=True)
contour_2 = Contour(Shape=brep_27, Point=point_2, Direction=vector_2pt_2.Vector, Distance=Slider(1, range=0..1))
partition_list = PartitionList(List=cull_index, Size=expr("x-1", list_length_3))  # -> simplify(Chunks)
directsunhours = LBDirectSunHours(
    vectors=flatten(sunpath.vectors),
    geometry=graft(brep_25),
    context=partition_list,
    grid_size=Slider(1, range=0..1),
    run=Toggle(True))  # -> report, points, results, mesh, legend, title, int_mtx; plug-in component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
option_five = Panel("3035352")
panel_7 = Panel(viewpercent.results)
brep_30 = Brep([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])  # disabled
mass_addition = MassAddition(Input=flatten(visibilitypercent.results))  # -> flatten(Result), PartialResults
area_2 = Area(Geometry=contour_2)  # -> Area, Centroid
area_3 = Area(Geometry=contour)  # -> Area, Centroid
brep_31 = Brep(flatten(partition_list))
skymatrix = LBCumulativeSkyMatrix(
    north=vector_2pt.Vector,
    location=importepw.location,
    direct_rad=importepw.direct_normal_rad,
    diffuse_rad=importepw.diffuse_horizontal_rad,
    hoys=hoy.hoy)  # -> out, sky_mtx; plug-in component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
option_six = Panel("2996278")
panel_8 = Panel(partition_list)
mass_addition_2 = MassAddition(Input=flatten(directsunhours.results))  # -> Result, PartialResults
equality = Equality(FirstNumber=panel_7, SecondNumber="0")  # -> Equality, Inequality
mass_addition_3 = MassAddition(Input=flatten(area_2.Area))  # -> Result, PartialResults
equality_2 = Equality(FirstNumber=visibilitypercent.results, SecondNumber="0")  # -> Equality, Inequality
brep_32 = Brep([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])  # disabled
mass_addition_4 = MassAddition(Input=flatten(area_3.Area))  # -> Result, PartialResults
mass_addition_5 = MassAddition(Input=flatten(area_3.Area))  # -> Result, PartialResults
option_seven = Panel("3099893")
context_2 = Brep([<brep referenced from the Rhino model> x15])
cull_pattern_2 = CullPattern(List=viewpercent.results, CullPattern=invert(equality.Equality))
cull_pattern_3 = CullPattern(List=visibilitypercent.results, CullPattern=invert(equality_2.Equality))
brep_33 = Brep([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])  # disabled
division_3 = Division(A=mass_addition_2.Result, B=mass_addition_5.Result)
run_it_2 = BooleanToggle(True)
output = Panel(mass_addition_2.Result)
panel_9 = Panel(mass_addition_4.Result)
option_eight = Panel("3017407")
average = Average(Input=cull_pattern_2)  # -> flatten(ArithmeticMean)
average_2 = Average(Input=cull_pattern_3)  # -> flatten(ArithmeticMean)
panel_10 = Panel(division_3)
brep_34 = Brep([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])  # disabled
incidentradiation = LBIncidentRadiation(
    sky_mtx=skymatrix.sky_mtx,
    geometry=flatten(brep_25),
    context=flatten(context_2),
    grid_size=Slider(1, range=0..1),
    offset_dist=Slider(0.01, range=0..0.01),
    parallel=run_it_2,
    run=run_it_2)  # -> out, points, results, total, mesh, legend, title, int_mtx; plug-in component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
panel_11 = Panel(average)
panel_12 = Panel(average_2)
mass_addition_6 = MassAddition(Input=incidentradiation.results)  # -> flatten(Result), PartialResults
geometry_2 = Geometry(incidentradiation.mesh)
division_4 = Division(A=mass_addition_4.Result, B=mass_addition_3.Result)
merge_3 = Merge(
    Data1=option_one,
    Data2=option_two,
    Data3=option_three,
    Data4=option_four,
    Data5=option_five,
    Data6=option_six,
    Data7=option_seven,
    Data8=option_eight)
panel_13 = Panel(merge_3)
merge_4 = Merge(
    Data1="SUNHOURS",
    Data2=mass_addition_2.Result,
    Data3="VISBILITY",
    Data4=average_2,
    Data5="ACCESS TO SKY GARDENS",
    Data6=average,
    Data7="AREA OF GARDENS",
    Data8=mass_addition_3.Result,
    Data9="FLOOR AREA",
    Data10=mass_addition_4.Result,
    Data11="SUN HOURS/FLOOR AREA",
    Data12=division_3,
    Data13="FLOOR AREA/AREA OF GARDENS",
    Data14=division_4,
    Data15="TOTAL/RADIATION",
    Data16=mass_addition_6.Result)
boolean_toggle_3 = BooleanToggle(False)
number = Number([2696871, 2920563, 3132236, 3061037, 3035352, 2996278, 3099893, 3017407])
file_path = FilePath("D:\TU_Delft\Msc_Building_Technology\Semester_3\Graduation\Prof Thijs\Massing Development\Stage 00 Selection.xlsx")
number_2 = Number([1824300, 1813200, 1944500, 2023500, 1980900, 1956100, 1924600, 1941200])
merge_5 = Merge(Data1=panel_13, Data2=number_2)
panel_14 = Panel(merge_4)
number_3 = Number(1824318.75)
option_one_2 = Panel(number_3)
number_4 = Number(1813217.308)
option_two_2 = Panel(number_4)
number_5 = Number(1944505.288)
option_three_2 = Panel(number_5)
number_6 = Number(2023504.087)
# Visibility
option_four_2 = Panel(number_6)
number_7 = Number(1980949.279)
option_five_2 = Panel(number_7)
number_8 = Number(1956124.519)
option_six_2 = Panel(number_8)
number_9 = Number(1924551.442)
option_seven_2 = Panel(number_9)
number_10 = Number(1941163.702)
merge_6 = Merge(
    Data1=number_3,
    Data2=number_4,
    Data3=number_5,
    Data4=number_6,
    Data5=number_7,
    Data6=number_8,
    Data7=number_9,
    Data8=number_10)
option_eight_2 = Panel(number_10)
panel_15 = Panel(merge_6)
