# Grasshopper definition 31-03-2021.gh (Grasshopper 1.0.7)
# plug-ins: ExcelReadWrite, Pufferfish

# ----
# Gardens Option 1
# Option_two
# Option_one
# Option_four
# Option_three
# Option_six
# Option_five
# Option_eleven
# Option_ten
# Option_seven
# Option_nine
# Option_eight
brep = Brep([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])
brep_2 = Brep([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])
brep_3 = Brep([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])
brep_4 = Brep([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])
brep_5 = Brep([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])
brep_6 = Brep(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)
brep_7 = Brep([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])
brep_8 = Brep([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])
brep_9 = Brep([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])
brep_10 = Brep([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])
brep_11 = Brep([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])

# ----
# Gardens Option 2
# Option_two
# Option_one
# Option_four
# Option_three
# Option_six
# Option_five
# Option_eleven
# Option_ten
# Option_seven
# Option_nine
# Option_eight
brep_12 = Brep([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])
brep_13 = Brep([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])
brep_14 = Brep([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])
brep_15 = Brep([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])
brep_16 = Brep([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])
brep_17 = Brep([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])
brep_18 = Brep([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])
brep_19 = Brep()
brep_20 = Brep([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])
brep_21 = Brep()
brep_22 = Brep([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])

# ----
# Stage 00
geometry_option_one = Brep([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])
brep_23 = Brep([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])
brep_24 = Brep([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])
brep_25 = Brep([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])
brep_26 = Brep([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])
brep_27 = Brep([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])
brep_28 = Brep([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])
brep_29 = Brep([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])

# ----
# Massing Options 1
# Option_one
# Option_two
# Option_six
# Option_four
# Option_five
# Option_three
# Option_ten
# Option_nine
# Option_eleven
# Option_eight
# Option_seven
brep_30 = Brep([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])
brep_31 = Brep([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])
brep_32 = Brep([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])
brep_33 = Brep([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])
brep_34 = Brep([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])
brep_35 = Brep([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])
brep_36 = Brep([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])
brep_37 = Brep([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])
brep_38 = Brep([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])
brep_39 = Brep([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])
brep_40 = Brep([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])

# ----
# Massing Options 2
# Option_one
# Option_two
# Option_three
# Option_four
# Option_five
# Option_six
# Option_eleven
# Option_seven
# Option_ten
# Option_eight
# Option_nine
brep_41 = Brep([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])
brep_42 = Brep([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])
brep_43 = Brep([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])
brep_44 = Brep([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])
brep_45 = Brep([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])
brep_46 = Brep([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])
brep_47 = Brep([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])
brep_48 = Brep()
brep_49 = Brep([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])
brep_50 = Brep()
brep_51 = Brep([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])

# ----
# EPW SETUP
panel = Panel("https://www.energyplus.net/weather-download/europe_wmo_region_6/NLD//NLD_Amsterdam.062400_IWEC/all")
downloadepw = LBDownloadWeather(weather_URL=panel)  # -> epw_file, stat_file, ddy_file; plug-in component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
importepw = LBImportEPW(epw_file=downloadepw.epw_file)  # -> location, dry_bulb_temperature, dew_point_temperature, relative_humidity, wind_speed, wind_direction, direct_normal_rad, diffuse_horizontal_rad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; plug-in component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

weight_for_road = Slider(5, range=0..10)
weight_for_kop_grasweg = Slider(3, range=0..10)
number_slider = Slider(10, range=0..10)
weight_for_ij = Slider(7, range=0..10)
# VISIBILITY ANALYSIS SETUP
ij_points = Curve(<curve referenced from the Rhino model>)
divide_distance = DivideDistance(Curve=ij_points, Distance=number_slider)  # -> Points, Tangents, Parameters
road_points = Curve(<curve referenced from the Rhino model>)
list_length = ListLength(List=divide_distance.Points)
divide_distance_2 = DivideDistance(Curve=road_points, Distance=number_slider)  # -> Points, Tangents, Parameters
geometry = Geometry(divide_distance.Points)
cop_grasweg_bridge = Point(<point referenced from the Rhino model>)
list_length_2 = ListLength(List=divide_distance_2.Points)
duplicate_data = DuplicateData(Data=weight_for_ij, Number=list_length, Order=True)
# SUN HOURS
# RADIATION ( FOR ENERGY)
# VISIBILITY
# ACCESS TO SKY(GARDENS)
# PRIVACY
# BUILT AREA / SUN HOURS
duplicate_data_2 = DuplicateData(Data=weight_for_road, Number=list_length_2, Order=True)
merge = Merge(Data1=cop_grasweg_bridge, Data2=divide_distance.Points, Data3=divide_distance_2.Points)  # -> flatten(Result)
merge_2 = Merge(Data1=weight_for_kop_grasweg, Data2=duplicate_data, Data3=duplicate_data_2)  # -> flatten(Result)

# ----
# HOYS's
panel_2 = Panel("1")
series = Series(Start=panel_2, Step=1, Count="12")
series_2 = Series(Start="7", Step=1, Count="9")
hoy = LBCalculateHOY(month=graft(series), hour=series_2)  # -> flatten(hoy), flatten(doy), flatten(date); plug-in component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

# ----
# SUN PATH
vector_2pt = Vector2Pt(PointA=Point(-592.3114903, -235.3755788, 0), PointB=Point(-648.4559105, -199.5409801, 0), Unitize=False)  # -> Vector, Length
point = Point(Point(149.4275346, -436.3937473, 0))
sunpath = LBSunPath(north=vector_2pt.Vector, location=importepw.location, hoys=hoy.hoy, center_pt=point, scale=1)  # -> report, vectors, altitudes, azimuths, hoys, sun_pts, analemma, daily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; plug-in component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

number_slider_2 = Slider(3, range=0..10)  # disabled

# ----
# INPUT BREPS
# MASSING BREP
brep_52 = Brep([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])
# GARDEN BREP
brep_53 = Brep([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])

brep_54 = Brep([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])  # disabled
brep_55 = Brep([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])  # disabled
brep_56 = Brep([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])

# ----
# ACCESS TO SKY
number_slider_3 = Slider(3, range=0..10)
# GREEN-BUILDING RATIO
boolean_toggle = BooleanToggle(True)
viewpercent = LBViewPercent(
    view_type=number_slider_3,
    geometry=flatten(brep_55),
    context=flatten(brep_56),
    grid_size=Slider(1, range=0..1),
    offset_dist=Slider(0.01, range=0..0.01),
    geo_block=boolean_toggle,
    parallel=boolean_toggle,
    run=boolean_toggle)  # -> out, points, view_vecs, results, mesh, legend, title, int_mtx; plug-in component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

# ----
# RADIATION ANALYSIS
skymatrix = LBCumulativeSkyMatrix(
    north=vector_2pt.Vector,
    location=importepw.location,
    direct_rad=importepw.direct_normal_rad,
    diffuse_rad=importepw.diffuse_horizontal_rad,
    hoys=hoy.hoy)  # -> out, sky_mtx; plug-in component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
context = Brep([<brep referenced from the Rhino model> x15])
run_it = BooleanToggle(True)
incidentradiation = LBIncidentRadiation(
    sky_mtx=skymatrix.sky_mtx,
    geometry=flatten(brep_56),
    context=flatten(context),
    grid_size=Slider(1, range=0..1),
    offset_dist=Slider(0.01, range=0..0.01),
    parallel=run_it,
    run=run_it)  # -> out, points, results, total, mesh, legend, title, int_mtx; plug-in component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

# ----
# PRIVACY
genpts = LBGeneratePointGrid(geometry=brep_56, grid_size=number_slider_2)  # -> points, vectors, face_areas, graft(mesh); disabled; plug-in component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

geo_block = BooleanToggle(True)
run_it_2 = BooleanToggle(True)
# VISIBILITY ANALYSIS
context_2 = Brep([<brep referenced from the Rhino model> x15])
visibilitypercent = LBVisibilityPercent(
    view_points=merge,
    pt_weights=merge_2,
    geometry=flatten(brep_56),
    context=flatten(context_2),
    grid_size=Slider(1, range=0..1),
    offset_dist=Slider(0.01, range=0..0.01),
    geo_block=geo_block,
    run=run_it_2)  # -> report, points, flatten(results), mesh, legend, title, int_mtx; plug-in component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

brep_57 = Brep([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])
number_slider_4 = Slider(44, range=0..100)  # disabled
deconstruct = Deconstruct(Point=genpts.points)  # -> XComponent, YComponent, ZComponent; disabled
larger_than = LargerThan(FirstNumber=deconstruct.ZComponent, SecondNumber=number_slider_4)  # -> LargerThan, OrEqualTo; disabled

equality = Equality(FirstNumber=visibilitypercent.results, SecondNumber="0")  # -> Equality, Inequality
cull_pattern = CullPattern(List=visibilitypercent.results, CullPattern=invert(equality.Equality))
mass_addition = MassAddition(Input=flatten(visibilitypercent.results))  # -> flatten(Result), PartialResults
average = Average(Input=cull_pattern)  # -> flatten(ArithmeticMean)
panel_3 = Panel(mass_addition.Result)
panel_4 = Panel(average)

# ----
# SUN-LIGHT HOURS ANALYSIS
# VISIBILITY ANALYSIS  RESULTS
list_length_3 = ListLength(List=brep_56)
duplicate_data_3 = DuplicateData(Data=brep_56, Number=list_length_3, Order=True)
series_3 = Series(Start=0, Step=1, Count=list_length_3)
multiplication = Multiplication(A=series_3, B=4)
cull_index = CullIndex(List=duplicate_data_3, Indices=multiplication, Wrap=True)
partition_list = PartitionList(List=cull_index, Size=expr("x-1", list_length_3))  # -> simplify(Chunks)
directsunhours = LBDirectSunHours(
    vectors=flatten(sunpath.vectors),
    geometry=graft(brep_56),
    context=partition_list,
    grid_size=Slider(1, range=0..1),
    run=Toggle(True))  # -> report, points, results, mesh, legend, title, int_mtx; plug-in component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

# ----
# ACCESS TO SKY RESULTS
equality_2 = Equality(FirstNumber=viewpercent.results, SecondNumber="0")  # -> Equality, Inequality
cull_pattern_2 = CullPattern(List=viewpercent.results, CullPattern=invert(equality_2.Equality))
average_2 = Average(Input=cull_pattern_2)  # -> flatten(ArithmeticMean)
panel_5 = Panel(average_2)

cull_pattern_3 = CullPattern(List=genpts.points, CullPattern=invert(larger_than.LargerThan))  # disabled
mass_addition_2 = MassAddition(Input=incidentradiation.results)  # -> flatten(Result), PartialResults
geometry_2 = Geometry(incidentradiation.mesh)
param_viewer = ParamViewer(cull_pattern_3)  # disabled
list_item = ListItem(List=param_viewer, Index=0, Wrap=True)  # disabled
tree_branch = TreeBranch(Tree=cull_pattern_3, Path=list_item, MaintainPaths=True)  # disabled
visibilitypercent_2 = LBVisibilityPercent()  # -> report, points, flatten(results), mesh, legend, title, int_mtx; disabled; plug-in component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

# ----
# SUN-LIGHT HOURS ANALYSIS  RESULTS
mass_addition_3 = MassAddition(Input=flatten(directsunhours.results))  # -> Result, PartialResults
equality_3 = Equality(FirstNumber=directsunhours.results, SecondNumber="0")  # -> Equality, Inequality
cull_pattern_4 = CullPattern(List=directsunhours.results, CullPattern=invert(equality_3.Equality))
average_3 = Average(Input=flatten(cull_pattern_4))  # -> flatten(ArithmeticMean)
panel_6 = Panel(average_3)

unit_z = UnitZ(Factor=1)
floor_height = Slider(3, range=0..10)
point_2 = Point(<point referenced from the Rhino model>)
move = Move(Geometry=point_2, Motion=unit_z)  # -> Geometry, Transform
vector_2pt_2 = Vector2Pt(PointA=point_2, PointB=move.Geometry, Unitize=False)  # -> Vector, Length
contour = Contour(Shape=brep_55, Point=point_2, Direction=vector_2pt_2.Vector, Distance=Slider(1, range=0..1))
contour_2 = Contour(Shape=flatten(brep_56), Point=point_2, Direction=vector_2pt_2.Vector, Distance=floor_height)
shift_paths = ShiftPaths(Data=contour, Offset=-1)
area = Area(Geometry=contour_2)  # -> Area, Centroid
list_item_2 = ListItem(List=simplify(shift_paths), Index="0", Wrap=True)
mass_addition_4 = MassAddition(Input=flatten(area.Area))  # -> Result, PartialResults
area_2 = Area(Geometry=list_item_2)  # -> Area, Centroid
mass_addition_5 = MassAddition(Input=flatten(area.Area))  # -> Result, PartialResults
mass_addition_6 = MassAddition(Input=flatten(area_2.Area))  # -> Result, PartialResults
division = Division(A=mass_addition_5.Result, B=mass_addition_6.Result)
division_2 = Division(A=mass_addition_3.Result, B=mass_addition_4.Result)

# ----
# SUNLIGHT-HOURS ON FACADES TO FLOOR AREA RATIO
division_3 = Division(A=mass_addition_4.Result, B=mass_addition_3.Result)
multiplication_2 = Multiplication(A=division_3, B=100)
panel_7 = Panel(multiplication_2)

merge_3 = Merge(Data1=mass_addition_3.Result, Data2=average)
panel_8 = Panel(merge_3)
data = Data([2709758, 40.53951579])
data_2 = Data([2933971, 39.32629119])
data_3 = Data([3285495, 39.91512621])
data_4 = Data([3070544, 40.71518716])
data_5 = Data([3046605, 40.66906072])
data_6 = Data([3002978, 39.06935606])
data_7 = Data([3107297, 38.46333524])
data_8 = Data([3022414, 38.21414064])
panel_9 = Panel(data)

# ----
# CUMULATIVE RESULTS
panel_10 = Panel("SUNHOURS")
merge_4 = Merge(
    Data1=panel_10,
    Data2=mass_addition_3.Result,
    Data3="VISBILITY",
    Data4=average,
    Data5="ACCESS TO SKY GARDENS",
    Data6=average_2,
    Data7="AREA OF GARDENS",
    Data8=mass_addition_6.Result,
    Data9="FLOOR AREA",
    Data10=mass_addition_5.Result,
    Data11="SUN HOURS/FLOOR AREA",
    Data12=division_2,
    Data13="FLOOR AREA/AREA OF GARDENS",
    Data14=division,
    Data15="TOTAL/RADIATION",
    Data16=mass_addition_2.Result,
    Data17="SUN_HOURS TO FLOOR AREA",
    Data18=multiplication_2)
panel_11 = Panel(merge_4)

# ----
# FINAL RESULTS Option 1
# Option_two
# Option_one
# Option_three
# Option_four
# Option_six
# Option_five
# Option_nine
# Option_seven
# Option_eight
# Option_ten
# Option_eleven
data_9 = Data(["SUNHOURS", 2427830, "VISBILITY", 29.440731, "ACCESS TO SKY GARDENS", 35.38054866, "AREA OF GARDENS", 5151.721645, "FLOOR AREA", 103500, "SUN HOURS/FLOOR AREA", 23.45729469, "FLOOR AREA/AREA OF GARDENS", 20.09037117, "TOTAL/RADIATION", 652732.6673, "SUN_HOURS TO FLOOR AREA", 4.263066195])
data_10 = Data(["SUNHOURS", 2956525, "VISBILITY", 35.77920703, "ACCESS TO SKY GARDENS", 46.93536652, "AREA OF GARDENS", 3565.056025, "FLOOR AREA", 152652, "SUN HOURS/FLOOR AREA", 19.36774494, "FLOOR AREA/AREA OF GARDENS", 42.81896243, "TOTAL/RADIATION", 756406.8995, "SUN_HOURS TO FLOOR AREA", 5.163223717])
data_11 = Data(["SUNHOURS", 3711793, "VISBILITY", 35.35748507, "ACCESS TO SKY GARDENS", 31.55883412, "AREA OF GARDENS", 5294.06199, "FLOOR AREA", 181807.0063, "SUN HOURS/FLOOR AREA", 20.41611638, "FLOOR AREA/AREA OF GARDENS", 34.34168444, "TOTAL/RADIATION", 1030795.07, "SUN_HOURS TO FLOOR AREA", 4.8980912])
data_12 = Data(["SUNHOURS", 2562197, "VISBILITY", 34.14306806, "ACCESS TO SKY GARDENS", 51.80250557, "AREA OF GARDENS", 5287.897776, "FLOOR AREA", 132069, "SUN HOURS/FLOOR AREA", 19.40044219, "FLOOR AREA/AREA OF GARDENS", 24.97570974, "TOTAL/RADIATION", 667882.0657, "SUN_HOURS TO FLOOR AREA", 5.154521686])
data_13 = Data(["SUNHOURS", 3294189, "VISBILITY", 38.06357337, "ACCESS TO SKY GARDENS", 21.87577488, "AREA OF GARDENS", 3318.618013, "FLOOR AREA", 156118.9581, "SUN HOURS/FLOOR AREA", 21.10050592, "FLOOR AREA/AREA OF GARDENS", 47.0433649, "TOTAL/RADIATION", 896884.7158, "SUN_HOURS TO FLOOR AREA", 4.739222859])
data_14 = Data(["SUNHOURS", 2388181, "VISBILITY", 38.81634883, "ACCESS TO SKY GARDENS", 48.85010601, "AREA OF GARDENS", 6970.926252, "FLOOR AREA", 94902, "SUN HOURS/FLOOR AREA", 25.16470675, "FLOOR AREA/AREA OF GARDENS", 13.61397275, "TOTAL/RADIATION", 595270.6974, "SUN_HOURS TO FLOOR AREA", 3.973819405])
data_15 = Data(["SUNHOURS", 2378246, "VISBILITY", 31.89223458, "ACCESS TO SKY GARDENS", 28.03350694, "AREA OF GARDENS", 4585.418988, "FLOOR AREA", 126561.2291, "SUN HOURS/FLOOR AREA", 18.7912682, "FLOOR AREA/AREA OF GARDENS", 27.60079929, "TOTAL/RADIATION", 671390.7268, "SUN_HOURS TO FLOOR AREA", 5.321620604])
data_16 = Data(["SUNHOURS", 1920341, "VISBILITY", 28.92039027, "ACCESS TO SKY GARDENS", 32.334249, "AREA OF GARDENS", 7263.72984, "FLOOR AREA", 65565.18299, "SUN HOURS/FLOOR AREA", 29.28903592, "FLOOR AREA/AREA OF GARDENS", 9.02637962, "TOTAL/RADIATION", 536987.0349, "SUN_HOURS TO FLOOR AREA", 3.414246896])
data_17 = Data(["SUNHOURS", 2168065, "VISBILITY", 30.73982227, "ACCESS TO SKY GARDENS", 44.97181072, "AREA OF GARDENS", 5350.86478, "FLOOR AREA", 125167.5, "SUN HOURS/FLOOR AREA", 17.32130945, "FLOOR AREA/AREA OF GARDENS", 23.39201328, "TOTAL/RADIATION", 601877.7314, "SUN_HOURS TO FLOOR AREA", 5.773235581])
data_18 = Data(["SUNHOURS", 2006767, "VISBILITY", 30.38361518, "ACCESS TO SKY GARDENS", 27.410417, "AREA OF GARDENS", 6559.122162, "FLOOR AREA", 76681.09249, "SUN HOURS/FLOOR AREA", 26.17029746, "FLOOR AREA/AREA OF GARDENS", 11.69075535, "TOTAL/RADIATION", 554855.4267, "SUN_HOURS TO FLOOR AREA", 3.821125845])
data_19 = Data(["SUNHOURS", 2217130, "VISBILITY", 37.62981714, "ACCESS TO SKY GARDENS", 50.57816896, "AREA OF GARDENS", 3697.97176, "FLOOR AREA", 98662.76534, "SUN HOURS/FLOOR AREA", 22.47180071, "FLOOR AREA/AREA OF GARDENS", 26.68023764, "TOTAL/RADIATION", 561108.6921, "SUN_HOURS TO FLOOR AREA", 4.450021665])

# ----
# FINAL RESULTS Option 2
# Option_one
# Option_two
# Option_three
# Option_four
# Option_five
# Option_six
# Option_ten
# Option_nine
# Option_seven
# Option_eleven
# Option_eight
data_20 = Data(["SUNHOURS", 2528983, "VISBILITY", 24.31669344, "ACCESS TO SKY GARDENS", 29.85301476, "AREA OF GARDENS", 4734.351846, "FLOOR AREA", 113400, "SUN HOURS/FLOOR AREA", 22.30143739, "FLOOR AREA/AREA OF GARDENS", 23.95259239, "TOTAL/RADIATION", 649484.7722, "SUN_HOURS TO FLOOR AREA", 4.484015907])

data_21 = Data(["SUNHOURS", 2643875, "VISBILITY", 38.27459269, "ACCESS TO SKY GARDENS", 28.11372725, "AREA OF GARDENS", 5117.582405, "FLOOR AREA", 116149.3325, "SUN HOURS/FLOOR AREA", 22.76272229, "FLOOR AREA/AREA OF GARDENS", 22.69613332, "TOTAL/RADIATION", 656069.1736, "SUN_HOURS TO FLOOR AREA", 4.393147654])
data_22 = Data(["SUNHOURS", 2620071, "VISBILITY", 35.64965459, "ACCESS TO SKY GARDENS", 15.42496497, "AREA OF GARDENS", 2686.363933, "FLOOR AREA", 127173.6027, "SUN HOURS/FLOOR AREA", 20.60231796, "FLOOR AREA/AREA OF GARDENS", 47.3404222, "TOTAL/RADIATION", 683523.6577, "SUN_HOURS TO FLOOR AREA", 4.853822768])
data_23 = Data(["SUNHOURS", 2501176, "VISBILITY", 36.30247918, "ACCESS TO SKY GARDENS", 44.33745951, "AREA OF GARDENS", 4039.213268, "FLOOR AREA", 154560, "SUN HOURS/FLOOR AREA", 16.18255694, "FLOOR AREA/AREA OF GARDENS", 38.26487728, "TOTAL/RADIATION", 646492.3682, "SUN_HOURS TO FLOOR AREA", 6.179493166])
data_24 = Data(["SUNHOURS", 2050428, "VISBILITY", 24.68365674, "ACCESS TO SKY GARDENS", 33.77312725, "AREA OF GARDENS", 8190.797808, "FLOOR AREA", 64290, "SUN HOURS/FLOOR AREA", 31.89342044, "FLOOR AREA/AREA OF GARDENS", 7.849052254, "TOTAL/RADIATION", 569935.3889, "SUN_HOURS TO FLOOR AREA", 3.135442942])
data_25 = Data(["SUNHOURS", 2197174, "VISBILITY", 35.46663175, "ACCESS TO SKY GARDENS", 45.86109373, "AREA OF GARDENS", 5529.291809, "FLOOR AREA", 103688.8896, "SUN HOURS/FLOOR AREA", 21.190062, "FLOOR AREA/AREA OF GARDENS", 18.75265282, "TOTAL/RADIATION", 572853.706, "SUN_HOURS TO FLOOR AREA", 4.719193365])
data_26 = Data(["SUNHOURS", 2638307, "VISBILITY", 36.76887182, "ACCESS TO SKY GARDENS", 22.88014188, "AREA OF GARDENS", 5237.448584, "FLOOR AREA", 121884, "SUN HOURS/FLOOR AREA", 21.6460487, "FLOOR AREA/AREA OF GARDENS", 23.27163657, "TOTAL/RADIATION", 709585.7985, "SUN_HOURS TO FLOOR AREA", 4.619780791])
data_27 = Data(["SUNHOURS", 2744259, "VISBILITY", 39.17015747, "ACCESS TO SKY GARDENS", 54.60398907, "AREA OF GARDENS", 5381.723948, "FLOOR AREA", 167913, "SUN HOURS/FLOOR AREA", 16.34333851, "FLOOR AREA/AREA OF GARDENS", 31.20059699, "TOTAL/RADIATION", 721842.4195, "SUN_HOURS TO FLOOR AREA", 6.118700895])
data_28 = Data(["SUNHOURS", 2427830, "VISBILITY", 29.440731, "ACCESS TO SKY GARDENS", 35.38054866, "AREA OF GARDENS", 5151.721645, "FLOOR AREA", 103500, "SUN HOURS/FLOOR AREA", 23.45729469, "FLOOR AREA/AREA OF GARDENS", 20.09037117, "TOTAL/RADIATION", 652732.6673, "SUN_HOURS TO FLOOR AREA", 4.263066195])
data_29 = Data(["SUNHOURS", 3711793, "VISBILITY", 35.35748507, "ACCESS TO SKY GARDENS", 31.55883412, "AREA OF GARDENS", 5294.06199, "FLOOR AREA", 181807.0063, "SUN HOURS/FLOOR AREA", 20.41611638, "FLOOR AREA/AREA OF GARDENS", 34.34168444, "TOTAL/RADIATION", 1030795.07, "SUN_HOURS TO FLOOR AREA", 4.8980912])
data_30 = Data(["SUNHOURS", 3294189, "VISBILITY", 38.06357337, "ACCESS TO SKY GARDENS", 21.87577488, "AREA OF GARDENS", 3318.618013, "FLOOR AREA", 156118.9581, "SUN HOURS/FLOOR AREA", 21.10050592, "FLOOR AREA/AREA OF GARDENS", 47.0433649, "TOTAL/RADIATION", 896884.7158, "SUN_HOURS TO FLOOR AREA", 4.739222859])
data_31 = Data(["SUNHOURS", 2378246, "VISBILITY", 31.89223458, "ACCESS TO SKY GARDENS", 28.03350694, "AREA OF GARDENS", 4585.418988, "FLOOR AREA", 126561.2291, "SUN HOURS/FLOOR AREA", 18.7912682, "FLOOR AREA/AREA OF GARDENS", 27.60079929, "TOTAL/RADIATION", 671390.7268, "SUN_HOURS TO FLOOR AREA", 5.321620604])
data_32 = Data(["SUNHOURS", 2562197, "VISBILITY", 34.14306806, "ACCESS TO SKY GARDENS", 51.80250557, "AREA OF GARDENS", 5287.897776, "FLOOR AREA", 132069, "SUN HOURS/FLOOR AREA", 19.40044219, "FLOOR AREA/AREA OF GARDENS", 24.97570974, "TOTAL/RADIATION", 667882.0657, "SUN_HOURS TO FLOOR AREA", 5.154521686])
data_33 = Data(["SUNHOURS", 2231702, "VISBILITY", 32.29472065, "ACCESS TO SKY GARDENS", 47.50184316, "AREA OF GARDENS", 4343.947759, "FLOOR AREA", 119300, "SUN HOURS/FLOOR AREA", 18.70663873, "FLOOR AREA/AREA OF GARDENS", 27.46349786, "TOTAL/RADIATION", 607209.157, "SUN_HOURS TO FLOOR AREA", 5.345695796])
data_34 = Data(["SUNHOURS", 2168065, "VISBILITY", 30.73982227, "ACCESS TO SKY GARDENS", 44.97181072, "AREA OF GARDENS", 5350.86478, "FLOOR AREA", 125167.5, "SUN HOURS/FLOOR AREA", 17.32130945, "FLOOR AREA/AREA OF GARDENS", 23.39201328, "TOTAL/RADIATION", 601877.7314, "SUN_HOURS TO FLOOR AREA", 5.773235581])
data_35 = Data(["SUNHOURS", 2217130, "VISBILITY", 37.62981714, "ACCESS TO SKY GARDENS", 50.57816896, "AREA OF GARDENS", 3697.97176, "FLOOR AREA", 98662.76534, "SUN HOURS/FLOOR AREA", 22.47180071, "FLOOR AREA/AREA OF GARDENS", 26.68023764, "TOTAL/RADIATION", 561108.6921, "SUN_HOURS TO FLOOR AREA", 4.450021665])
data_36 = Data(["SUNHOURS", 2956525, "VISBILITY", 35.77920703, "ACCESS TO SKY GARDENS", 46.93536652, "AREA OF GARDENS", 3565.056025, "FLOOR AREA", 152652, "SUN HOURS/FLOOR AREA", 19.36774494, "FLOOR AREA/AREA OF GARDENS", 42.81896243, "TOTAL/RADIATION", 756406.8995, "SUN_HOURS TO FLOOR AREA", 5.163223717])
data_37 = Data(["SUNHOURS", 2050428, "VISBILITY", 24.68365674, "ACCESS TO SKY GARDENS", 33.77312725, "AREA OF GARDENS", 8190.797808, "FLOOR AREA", 64290, "SUN HOURS/FLOOR AREA", 31.89342044, "FLOOR AREA/AREA OF GARDENS", 7.849052254, "TOTAL/RADIATION", 569935.3889, "SUN_HOURS TO FLOOR AREA", 3.135442942])
data_38 = Data(["SUNHOURS", 2388181, "VISBILITY", 38.81634883, "ACCESS TO SKY GARDENS", 48.85010601, "AREA OF GARDENS", 6970.926252, "FLOOR AREA", 94902, "SUN HOURS/FLOOR AREA", 25.16470675, "FLOOR AREA/AREA OF GARDENS", 13.61397275, "TOTAL/RADIATION", 595270.6974, "SUN_HOURS TO FLOOR AREA", 3.973819405])
data_39 = Data(["SUNHOURS", 2501176, "VISBILITY", 36.30247918, "ACCESS TO SKY GARDENS", 44.33745951, "AREA OF GARDENS", 4039.213268, "FLOOR AREA", 154560, "SUN HOURS/FLOOR AREA", 16.18255694, "FLOOR AREA/AREA OF GARDENS", 38.26487728, "TOTAL/RADIATION", 646492.3682, "SUN_HOURS TO FLOOR AREA", 6.179493166])
data_40 = Data(["SUNHOURS", 1920341, "VISBILITY", 28.92039027, "ACCESS TO SKY GARDENS", 32.334249, "AREA OF GARDENS", 7263.72984, "FLOOR AREA", 65565.18299, "SUN HOURS/FLOOR AREA", 29.28903592, "FLOOR AREA/AREA OF GARDENS", 9.02637962, "TOTAL/RADIATION", 536987.0349, "SUN_HOURS TO FLOOR AREA", 3.414246896])
data_41 = Data(["SUNHOURS", 2744259, "VISBILITY", 39.17015747, "ACCESS TO SKY GARDENS", 54.60398907, "AREA OF GARDENS", 5381.723948, "FLOOR AREA", 167913, "SUN HOURS/FLOOR AREA", 16.34333851, "FLOOR AREA/AREA OF GARDENS", 31.20059699, "TOTAL/RADIATION", 721842.4195, "SUN_HOURS TO FLOOR AREA", 6.118700895])
data_42 = Data(["SUNHOURS", 2643875, "VISBILITY", 38.27459269, "ACCESS TO SKY GARDENS", 28.11372725, "AREA OF GARDENS", 5117.582405, "FLOOR AREA", 116149.3325, "SUN HOURS/FLOOR AREA", 22.76272229, "FLOOR AREA/AREA OF GARDENS", 22.69613332, "TOTAL/RADIATION", 656069.1736, "SUN_HOURS TO FLOOR AREA", 4.393147654])
data_43 = Data(["SUNHOURS", 2006767, "VISBILITY", 30.38361518, "ACCESS TO SKY GARDENS", 27.410417, "AREA OF GARDENS", 6559.122162, "FLOOR AREA", 76681.09249, "SUN HOURS/FLOOR AREA", 26.17029746, "FLOOR AREA/AREA OF GARDENS", 11.69075535, "TOTAL/RADIATION", 554855.4267, "SUN_HOURS TO FLOOR AREA", 3.821125845])
data_44 = Data(["SUNHOURS", 2197174, "VISBILITY", 35.46663175, "ACCESS TO SKY GARDENS", 45.86109373, "AREA OF GARDENS", 5529.291809, "FLOOR AREA", 103688.8896, "SUN HOURS/FLOOR AREA", 21.190062, "FLOOR AREA/AREA OF GARDENS", 18.75265282, "TOTAL/RADIATION", 572853.706, "SUN_HOURS TO FLOOR AREA", 4.719193365])
data_45 = Data(["SUNHOURS", 2528983, "VISBILITY", 24.31669344, "ACCESS TO SKY GARDENS", 29.85301476, "AREA OF GARDENS", 4734.351846, "FLOOR AREA", 113400, "SUN HOURS/FLOOR AREA", 22.30143739, "FLOOR AREA/AREA OF GARDENS", 23.95259239, "TOTAL/RADIATION", 649484.7722, "SUN_HOURS TO FLOOR AREA", 4.484015907])
data_46 = Data(["SUNHOURS", 2638307, "VISBILITY", 36.76887182, "ACCESS TO SKY GARDENS", 22.88014188, "AREA OF GARDENS", 5237.448584, "FLOOR AREA", 121884, "SUN HOURS/FLOOR AREA", 21.6460487, "FLOOR AREA/AREA OF GARDENS", 23.27163657, "TOTAL/RADIATION", 709585.7985, "SUN_HOURS TO FLOOR AREA", 4.619780791])
data_47 = Data(["SUNHOURS", 2620071, "VISBILITY", 35.64965459, "ACCESS TO SKY GARDENS", 15.42496497, "AREA OF GARDENS", 2686.363933, "FLOOR AREA", 127173.6027, "SUN HOURS/FLOOR AREA", 20.60231796, "FLOOR AREA/AREA OF GARDENS", 47.3404222, "TOTAL/RADIATION", 683523.6577, "SUN_HOURS TO FLOOR AREA", 4.853822768])
data_48 = Data(["SUNHOURS", 2231702, "VISBILITY", 32.29472065, "ACCESS TO SKY GARDENS", 47.50184316, "AREA OF GARDENS", 4343.947759, "FLOOR AREA", 119300, "SUN HOURS/FLOOR AREA", 18.70663873, "FLOOR AREA/AREA OF GARDENS", 27.46349786, "TOTAL/RADIATION", 607209.157, "SUN_HOURS TO FLOOR AREA", 5.345695796])
merge_5 = Merge(
    Data1=data_28,
    Data2=data_29,
    Data3=data_30,
    Data4=data_31,
    Data5=data_34,
    Data6=data_35,
    Data7=data_36,
    Data8=data_32,
    Data9=data_38,
    Data10=data_40,
    Data11=data_43,
    Data12=data_45,
    Data13=data_47,
    Data14=data_44,
    Data15=data_46,
    Data16=data_41,
    Data17=data_33,
    Data18=data_42,
    Data19=data_39,
    Data20=data_37)
panel_12 = Panel("B2/((B2^2)+(B3^2)+(B4^2)+(B5^2)+(B6^2)+(B7^2)+(B8^2)+(B9^2))^0,5")
list_length_4 = ListLength(List=data_28)
# Normalised Matrix
partition_list_2 = PartitionList(List=merge_5, Size=list_length_4)
data_49 = Data(["SUNHOURS", 2217130, "VISBILITY", 37.62981714, "ACCESS TO SKY GARDENS", 50.57816896, "AREA OF GARDENS", 3697.97176, "FLOOR AREA", 98662.76534, "SUN HOURS/FLOOR AREA", 22.47180071, "FLOOR AREA/AREA OF GARDENS", 26.68023764, "TOTAL/RADIATION", 561108.6921, "SUN_HOURS TO FLOOR AREA", 4.450021665])
number_slider_5 = Slider(0, range=0..18)
number_slider_6 = Slider(4, range=0..18)
number_slider_7 = Slider(2, range=0..18)
number_slider_8 = Slider(8, range=0..18)
number_slider_9 = Slider(6, range=0..18)
number_slider_10 = Slider(10, range=0..18)
number_slider_11 = Slider(12, range=0..18)
number_slider_12 = Slider(14, range=0..18)
number_slider_13 = Slider(16, range=0..18)
list_item_3 = ListItem(List=partition_list_2, Index=number_slider_5, Wrap=True)
list_item_4 = ListItem(List=partition_list_2, Index=Slider(1, range=0..18), Wrap=True)
list_item_5 = ListItem(List=partition_list_2, Index=number_slider_6, Wrap=True)
list_item_6 = ListItem(List=partition_list_2, Index=number_slider_7, Wrap=True)
list_item_7 = ListItem(List=partition_list_2, Index=number_slider_8, Wrap=True)
list_item_8 = ListItem(List=partition_list_2, Index=number_slider_10, Wrap=True)
list_item_9 = ListItem(List=partition_list_2, Index=Slider(5, range=0..18), Wrap=True)
list_item_10 = ListItem(List=partition_list_2, Index=number_slider_9, Wrap=True)
list_item_11 = ListItem(List=partition_list_2, Index=Slider(3, range=0..18), Wrap=True)
list_item_12 = ListItem(List=partition_list_2, Index=number_slider_11, Wrap=True)
list_item_13 = ListItem(List=partition_list_2, Index=Slider(9, range=0..18), Wrap=True)
list_item_14 = ListItem(List=partition_list_2, Index=Slider(11, range=0..18), Wrap=True)
list_item_15 = ListItem(List=partition_list_2, Index=Slider(7, range=0..18), Wrap=True)
list_item_16 = ListItem(List=partition_list_2, Index=Slider(13, range=0..18), Wrap=True)
list_item_17 = ListItem(List=partition_list_2, Index=number_slider_12, Wrap=True)
list_item_18 = ListItem(List=partition_list_2, Index=number_slider_13, Wrap=True)
list_item_19 = ListItem(List=partition_list_2, Index=Slider(15, range=0..18), Wrap=True)
list_item_20 = ListItem(List=partition_list_2, Index=Slider(17, range=0..18), Wrap=True)
list_item_21 = ListItem(List=flatten(list_item_3), Index=number_slider_5, Wrap=True)
list_item_22 = ListItem(List=flatten(list_item_5), Index=number_slider_6, Wrap=True)
flatten_tree = FlattenTree(Tree=list_item_4, Path="{0}")
list_item_23 = ListItem(List=flatten(list_item_6), Index=number_slider_7, Wrap=True)
list_item_24 = ListItem(List=flatten(list_item_7), Index=number_slider_8, Wrap=True)
list_item_25 = ListItem(List=flatten(list_item_8), Index=number_slider_10, Wrap=True)
list_item_26 = ListItem(List=flatten(list_item_10), Index=number_slider_9, Wrap=True)
flatten_tree_2 = FlattenTree(Tree=list_item_9, Path="{0}")
flatten_tree_3 = FlattenTree(Tree=list_item_11, Path="{0}")
list_item_27 = ListItem(List=flatten(list_item_12), Index=number_slider_11, Wrap=True)
flatten_tree_4 = FlattenTree(Tree=list_item_13, Path="{0}")
flatten_tree_5 = FlattenTree(Tree=list_item_14, Path="{0}")
flatten_tree_6 = FlattenTree(Tree=list_item_15, Path="{0}")
flatten_tree_7 = FlattenTree(Tree=list_item_16, Path="{0}")
list_item_28 = ListItem(List=flatten(list_item_17), Index=number_slider_12, Wrap=True)
list_item_29 = ListItem(List=flatten(list_item_18), Index=number_slider_13, Wrap=True)
flatten_tree_8 = FlattenTree(Tree=list_item_19, Path="{0}")
flatten_tree_9 = FlattenTree(Tree=list_item_20, Path="{0}")
panel_13 = Panel(flatten_tree)
panel_14 = Panel(flatten_tree_2)
panel_15 = Panel(flatten_tree_3)
panel_16 = Panel(list_item_23)
panel_17 = Panel(flatten_tree_4)
panel_18 = Panel(flatten_tree_6)
panel_19 = Panel(flatten_tree_5)
panel_20 = Panel(list_item_21)
panel_21 = Panel(flatten_tree_7)
panel_22 = Panel(list_item_27)
panel_23 = Panel(list_item_22)
panel_24 = Panel(flatten_tree_8)
panel_25 = Panel(list_item_26)
panel_26 = Panel(list_item_25)
panel_27 = Panel(list_item_29)
panel_28 = Panel(flatten_tree_9)
panel_29 = Panel(list_item_24)
panel_30 = Panel(list_item_28)
merge_6 = Merge(Data1=panel_20, Data2=panel_13)
merge_7 = Merge(Data1=panel_16, Data2=panel_15)
merge_8 = Merge(Data1=panel_23, Data2=panel_14)
merge_9 = Merge(Data1=panel_25, Data2=panel_18)
merge_10 = Merge(Data1=panel_29, Data2=panel_17)
merge_11 = Merge(Data1=panel_22, Data2=panel_21)
brep_58 = Brep([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])
brep_59 = Brep([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])
merge_12 = Merge(Data1=panel_26, Data2=panel_19)
brep_60 = Brep([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])
# TOPSIS RANKING
brep_61 = Brep([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])
brep_62 = Brep([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])
brep_63 = Brep([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])
brep_64 = Brep([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])
brep_65 = Brep([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])
brep_66 = Brep([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])
brep_67 = Brep([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])
brep_68 = Brep([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])
brep_69 = Brep([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])
brep_70 = Brep([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])
brep_71 = Brep([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])
brep_72 = Brep([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])
brep_73 = Brep([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])
brep_74 = Brep([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])
brep_75 = Brep([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])
merge_13 = Merge(Data1=panel_30, Data2=panel_24)
brep_76 = Brep([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])
brep_77 = Brep([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])
merge_14 = Merge(Data1=panel_27, Data2=panel_28)
brep_78 = Brep([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])
brep_79 = Brep([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])
brep_80 = Brep([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])
brep_81 = Brep([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])
brep_82 = Brep([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])
brep_83 = Brep([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])
brep_84 = Brep([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])
brep_85 = Brep([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])
brep_86 = Brep([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])
brep_87 = Brep(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)
brep_88 = Brep([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])
brep_89 = Brep([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])
brep_90 = Brep([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])
brep_91 = Brep([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])
brep_92 = Brep([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])
brep_93 = Brep([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])
brep_94 = Brep([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])
brep_95 = Brep([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])
brep_96 = Brep([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])
brep_97 = Brep([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])
merge_15 = Merge(
    Data1=graft(merge_6),
    Data2=graft(merge_7),
    Data3=graft(merge_8),
    Data4=graft(merge_9),
    Data5=graft(merge_10),
    Data6=graft(merge_12),
    Data7=graft(merge_11),
    Data8=graft(merge_13),
    Data9=graft(merge_14))
list_length_5 = ListLength(List=brep_63)
list_length_6 = ListLength(List=brep_66)
list_length_7 = ListLength(List=brep_64)
list_length_8 = ListLength(List=brep_62)
list_length_9 = ListLength(List=brep_58)
list_length_10 = ListLength(List=brep_60)
list_length_11 = ListLength(List=brep_61)
list_length_12 = ListLength(List=brep_65)
list_length_13 = ListLength(List=brep_59)
list_length_14 = ListLength(List=brep_74)
list_length_15 = ListLength(List=brep_69)
list_length_16 = ListLength(List=brep_73)
list_length_17 = ListLength(List=brep_68)
list_length_18 = ListLength(List=brep_67)
list_length_19 = ListLength(List=brep_70)
flip_matrix = FlipMatrix(Data=merge_15)
list_length_20 = ListLength(List=brep_75)
list_length_21 = ListLength(List=brep_71)
list_length_22 = ListLength(List=brep_72)
list_length_23 = ListLength(List=brep_76)
list_length_24 = ListLength(List=brep_77)
file_path = FilePath("D:\TU_Delft\Msc_Building_Technology\Semester_3\Graduation\Prof Thijs\Scale01\Data from Gh.xlsx")

# ----
# Direct_sunlight_hours for Step 0
option_one = Panel("2696871")
geometry_option_one_2 = Brep([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])  # disabled
option_two = Panel("2920563")
brep_98 = Brep([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])  # disabled
option_three = Panel("3132236")
brep_99 = Brep([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])  # disabled
option_four = Panel("3061037")
brep_100 = Brep([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])  # disabled
option_five = Panel("3035352")
brep_101 = Brep([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])  # disabled
option_six = Panel("2996278")
brep_102 = Brep([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])  # disabled
option_seven = Panel("3099893")
brep_103 = Brep([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])  # disabled
option_eight = Panel("3017407")
brep_104 = Brep([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])  # disabled
number = Number([1824300, 1813200, 1944500, 2023500, 1980900, 1956100, 1924600, 1941200])
merge_16 = Merge(
    Data1=option_one,
    Data2=option_two,
    Data3=option_three,
    Data4=option_four,
    Data5=option_five,
    Data6=option_six,
    Data7=option_seven,
    Data8=option_eight)
panel_31 = Panel(merge_16)
number_2 = Number([2696871, 2920563, 3132236, 3061037, 3035352, 2996278, 3099893, 3017407])
merge_17 = Merge(Data1=panel_31, Data2=number)

# ----
# STEP 0
# Visibility for step 0
number_3 = Number(1824318.75)
option_one_2 = Panel(number_3)
number_4 = Number(1813217.308)
option_two_2 = Panel(number_4)
number_5 = Number(1944505.288)
option_three_2 = Panel(number_5)
number_6 = Number(2023504.087)
option_four_2 = Panel(number_6)
number_7 = Number(1980949.279)
option_five_2 = Panel(number_7)
number_8 = Number(1956124.519)
option_six_2 = Panel(number_8)
number_9 = Number(1924551.442)
option_seven_2 = Panel(number_9)
number_10 = Number(1941163.702)
merge_18 = Merge(
    Data1=number_3,
    Data2=number_4,
    Data3=number_5,
    Data4=number_6,
    Data5=number_7,
    Data6=number_8,
    Data7=number_9,
    Data8=number_10)
option_eight_2 = Panel(number_10)
panel_32 = Panel(merge_18)

excelwrite = ExcelWrite(ExcelFile=file_path, Connect=Toggle(False), Sheet1=flip_matrix)
evaluate = Evaluate()
list_length_25 = ListLength(List=brep_78)
list_length_26 = ListLength(List=brep_79)
list_length_27 = ListLength(List=brep_80)
list_length_28 = ListLength(List=brep_81)
list_length_29 = ListLength(List=brep_82)
list_length_30 = ListLength(List=brep_83)
list_length_31 = ListLength(List=brep_84)
list_length_32 = ListLength(List=brep_85)
list_length_33 = ListLength(List=brep_87)
list_length_34 = ListLength(List=brep_86)
list_length_35 = ListLength(List=brep_88)
list_length_36 = ListLength(List=brep_89)
list_length_37 = ListLength(List=brep_93)
list_length_38 = ListLength(List=brep_92)
list_length_39 = ListLength(List=brep_90)
list_length_40 = ListLength(List=brep_95)
list_length_41 = ListLength(List=brep_97)
list_length_42 = ListLength(List=brep_96)
list_length_43 = ListLength(List=brep_91)
list_length_44 = ListLength(List=brep_94)
square = Square()
panel_33 = Panel("""0.49840534244749907
0.5390079665860319
0.3712911520760497
0.409110120319819
0.4904048879853061
0.45990677355368514
0.422434766915811
0.5413147702752414
0.6110807972936226
0.5454319270489574
0.5172856428876941
0.4415503954808691
0.2527388992498656
0.5291940302875471
0.47168116400030247
0.542986187989989
0.45494059707227225
0.4871575020885584
0.41553609909137545
0.569329684993132""")
panel_34 = Panel(flip_matrix)
merge_19 = Merge(
    Data1=brep_66,
    Data2=brep_58,
    Data3=brep_61,
    Data4=brep_60,
    Data5=brep_63,
    Data6=brep_64,
    Data7=brep_65,
    Data8=brep_59,
    Data9=brep_62,
    Data10=brep_73,
    Data11=brep_74,
    Data12=brep_69,
    Data13=brep_67,
    Data14=brep_68,
    Data15=brep_71,
    Data16=brep_70,
    Data17=brep_75,
    Data18=brep_72,
    Data19=brep_77,
    Data20=brep_76)
merge_20 = Merge(
    Data1=list_length_6,
    Data2=list_length_9,
    Data3=list_length_11,
    Data4=list_length_10,
    Data5=list_length_5,
    Data6=list_length_7,
    Data7=list_length_12,
    Data8=list_length_13,
    Data9=list_length_8,
    Data10=list_length_16,
    Data11=list_length_14,
    Data12=list_length_15,
    Data13=list_length_18,
    Data14=list_length_17,
    Data15=list_length_21,
    Data16=list_length_19,
    Data17=list_length_20,
    Data18=list_length_22,
    Data19=list_length_24,
    Data20=list_length_23)
merge_21 = Merge(
    Data1=brep_78,
    Data2=brep_79,
    Data3=brep_80,
    Data4=brep_81,
    Data5=brep_82,
    Data6=brep_83,
    Data7=brep_84,
    Data8=brep_85,
    Data9=brep_87,
    Data10=brep_86,
    Data11=brep_88,
    Data12=brep_89,
    Data13=brep_92,
    Data14=brep_93,
    Data15=brep_90,
    Data16=brep_91,
    Data17=brep_94,
    Data18=brep_96,
    Data19=brep_95,
    Data20=brep_97)
merge_22 = Merge(
    Data1=list_length_25,
    Data2=list_length_26,
    Data3=list_length_27,
    Data4=list_length_28,
    Data5=list_length_29,
    Data6=list_length_30,
    Data7=list_length_31,
    Data9=list_length_32,
    Data10=list_length_33,
    Data11=list_length_34,
    Data12=list_length_35,
    Data13=list_length_36,
    Data14=list_length_38,
    Data15=list_length_37,
    Data16=list_length_39,
    Data17=list_length_43,
    Data18=list_length_44,
    Data19=list_length_42,
    Data20=list_length_40,
    Data21=list_length_41)
panel_35 = Panel("""9
6
19
18
10
13
16
5
1
3
8
15
20
7
12
4
14
11
17
2""")
round_to_decimal_place = RoundToDecimalPlace(NumberX=panel_33, DecimalPlace=Slider(2, range=0..10), RoundType=0)  # -> Rounded, Difference
partition_list_3 = PartitionList(List=merge_19, Size=merge_20)  # -> simplify(Chunks)
subtraction = Subtraction(A=panel_35, B=1)
sort_list = SortList(Keys=subtraction, ValuesValuesA=round_to_decimal_place.Rounded)  # -> Keys, ValuesValuesA
number_slider_14 = Slider(19, range=0..19)
list_length_45 = ListLength(List=subtraction)
partition_list_4 = PartitionList(List=merge_21, Size=merge_22)  # -> simplify(Chunks)
panel_36 = Panel(sort_list.ValuesValuesA)
graft_tree = GraftTree(Tree="Closeness", IncludeEmptyLists=True, IncludeNullItems=True)
list_length_46 = ListLength(List=round_to_decimal_place.Rounded)
panel_37 = Panel(partition_list_3)
series_4 = Series(Start=0, Step=1, Count=list_length_45)
graft_tree_2 = GraftTree(Tree=sort_list.ValuesValuesA, IncludeEmptyLists=True, IncludeNullItems=True)  # -> simplify(Tree)
sort_list_2 = SortList(Keys=subtraction, ValuesValuesA=series_4)  # -> Keys, ValuesValuesA
duplicate_data_4 = DuplicateData(Data=graft_tree, Number=list_length_46, Order=True)  # -> simplify(graft(Data))
list_item_30 = ListItem(List=sort_list_2.ValuesValuesA, Index=number_slider_14, Wrap=True)
number_slider_15 = Slider(9, range=0..10)
number_slider_16 = Slider(11, range=0..100)
text_join = TextJoin(Text=[duplicate_data_4, graft_tree_2], Join="_")
brep_105 = Brep([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])
panel_38 = Panel(sort_list_2.ValuesValuesA)
tree_branch_2 = TreeBranch(Tree=partition_list_3, Path=list_item_30, MaintainPaths=True)
brep_106 = Brep([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])
custom_preview = CustomPreview(Geometry=tree_branch_2, Material=ColourSwatch(SwatchColor=RGB(187, 144, 255)))
panel_39 = Panel(text_join)
graft_tree_3 = GraftTree(Tree="Design_option", IncludeEmptyLists=True, IncludeNullItems=True)
panel_40 = Panel(list_item_30)
list_length_47 = ListLength(List=panel_38)
duplicate_data_5 = DuplicateData(Data=brep_106, Number=number_slider_15, Order=True)
duplicate_data_6 = DuplicateData(Data=brep_105, Number=number_slider_16, Order=True)
list_length_48 = ListLength(List=brep_106)
tree_branch_3 = TreeBranch(Tree=partition_list_4, Path=list_item_30, MaintainPaths=True)
list_length_49 = ListLength(List=brep_105)
graft_tree_4 = GraftTree(Tree=panel_38, IncludeEmptyLists=True, IncludeNullItems=True)  # -> simplify(Tree)
custom_preview_2 = CustomPreview(Geometry=tree_branch_3, Material=ColourSwatch(SwatchColor=RGB(95, 232, 105)))
number_slider_17 = Slider(4, range=0..10)
duplicate_data_7 = DuplicateData(Data=graft_tree_3, Number=list_length_47, Order=True)  # -> simplify(graft(Data))
text_join_2 = TextJoin(Text=[duplicate_data_7, graft_tree_4], Join="_")
list_item_31 = ListItem(List=flatten(text_join_2), Index=number_slider_14, Wrap=True)
list_item_32 = ListItem(List=flatten(panel_39), Index=number_slider_14, Wrap=True)
unit_z_2 = UnitZ(Factor=expr("x*3", number_slider_17))
text_join_3 = TextJoin(Text=flatten([number_slider_14, "Ranking"]), Join="_")
duplicate_data_8 = DuplicateData(Data=list_length_49, Number=number_slider_16, Order=True)
duplicate_data_9 = DuplicateData(Data=list_length_48, Number=number_slider_15, Order=True)
point_3 = Point(<point referenced from the Rhino model>)
merge_23 = Merge(Data1=duplicate_data_6, Data2=duplicate_data_5)
data_50 = Data([2709758, 40.53951579])
number_slider_18 = Slider(0, range=0..3)
panel_41 = Panel(text_join_2)
xz_plane = XZPlane(Origin=point_3)
data_51 = Data([2933971, 39.32629119])
merge_24 = Merge(Data1=list_item_31, Data2=list_item_32, Data4=text_join_3)
list_length_50 = ListLength(List=merge_24)
linear_array = LinearArray(Geometry=xz_plane, Direction=unit_z_2, Count=list_length_50)  # -> Geometry, Transform
merge_25 = Merge(Data1=duplicate_data_8, Data2=duplicate_data_9)
data_52 = Data([3285495, 39.91512621])
data_53 = Data([3070544, 40.71518716])
partition_list_5 = PartitionList(List=merge_23, Size=merge_25)  # -> simplify(Chunks)
panel_42 = Panel(merge_24)
colour_swatch = ColourSwatch(SwatchColor=RGB(234, 8, 0))
data_54 = Data([3046605, 40.66906072])
tree_branch_4 = TreeBranch(Tree=partition_list_5, Path=list_item_30, MaintainPaths=True)
text_tag = TextTag(Location=linear_array.Geometry, Text=merge_24, Colour=colour_swatch)
text_tag_3d = TextTag3D(Location=linear_array.Geometry, Text=merge_24, Size=number_slider_17, Colour=colour_swatch, Justification=7)
data_55 = Data([3002978, 39.06935606])
panel_43 = Panel("""SLH
VIS""")
data_56 = Data([3107297, 38.46333524])
custom_preview_3 = CustomPreview(Geometry=tree_branch_4, Material=ColourSwatch(SwatchColor=RGB(249, 200, 97)))
data_57 = Data([3022414, 38.21414064])
merge_26 = Merge(
    Data1=graft(panel_43),
    Data2=graft(data_50),
    Data3=graft(data_51),
    Data4=graft(data_52),
    Data5=graft(data_53),
    Data6=graft(data_54),
    Data7=graft(data_55),
    Data8=graft(data_56),
    Data9=graft(data_57))
panel_44 = Panel("""0.23569414606865244
0.39503318388731345
0.9061867313691097
0.6550738428881077
0.6173820799388781
0.49277384976950983
0.6164294451424751
0.4902370777440009""")
panel_45 = Panel(merge_26)
round_to_decimal_place_2 = RoundToDecimalPlace(NumberX=panel_44, DecimalPlace=Slider(2, range=0..10), RoundType=0)  # -> Rounded, Difference
file_path_2 = FilePath("D:\TU_Delft\Msc_Building_Technology\Semester_3\Graduation\Prof Thijs\Massing Development\Scale00_MCDA.xlsx")
panel_46 = Panel(round_to_decimal_place_2.Rounded)
excelwrite_2 = ExcelWrite(ExcelFile=file_path_2, Connect=Toggle(False), Sheet1=merge_26)
