# Grasshopper definition Option_2_6042020.gh (Grasshopper 1.0.7)
# plug-ins: Pufferfish, ExcelReadWrite, Voxelizer

multiplication = Multiplication(A="3", B=Slider(16, range=0..40))
multiplication_2 = Multiplication(A="3", B=Slider(16, range=0..40))
multiplication_3 = Multiplication(A="3", B=Slider(5, range=0..40))
multiplication_4 = Multiplication(A="3", B=Slider(4, range=0..40))
multiplication_5 = Multiplication(A="3", B=Slider(13, range=0..40))
multiplication_6 = Multiplication(A="3", B=Slider(5, range=0..40))
multiplication_7 = Multiplication(A="3", B=Slider(12, range=0..40))
multiplication_8 = Multiplication(A="3", B=Slider(4, range=0..40))
multiplication_9 = Multiplication(A="3", B=Slider(4, range=0..40))
multiplication_10 = Multiplication(A="3", B=Slider(10, range=0..40))
multiplication_11 = Multiplication(A="3", B=Slider(4, range=0..40))
multiplication_12 = Multiplication(A="3", B=Slider(11, range=0..40))
point = Point(<point referenced from the Rhino model>)
multiplication_13 = Multiplication(A="3", B=Slider(4, range=0..40))
multiplication_14 = Multiplication(A="3", B=Slider(10, range=0..40))
multiplication_15 = Multiplication(A="3", B=Slider(4, range=0..40))
multiplication_16 = Multiplication(A="3", B=Slider(11, range=0..40))
multiplication_17 = Multiplication(A="3", B=Slider(4, range=0..40))
multiplication_18 = Multiplication(A="3", B=Slider(10, range=0..40))
multiplication_19 = Multiplication(A="3", B=Slider(4, range=0..40))
multiplication_20 = Multiplication(A="3", B=Slider(11, range=0..40))
multiplication_21 = Multiplication(A="3", B=Slider(4, range=0..40))
multiplication_22 = Multiplication(A="3", B=Slider(10, range=0..40))
multiplication_23 = Multiplication(A="3", B=Slider(4, range=0..40))
multiplication_24 = Multiplication(A="3", B=Slider(10, range=0..40))
multiplication_25 = Multiplication(A="3", B=Slider(4, range=0..40))
multiplication_26 = Multiplication(A="3", B=Slider(11, range=0..40))
negative = Negative(Value=multiplication)
multiplication_27 = Multiplication(A="3", B=Slider(4, range=0..40))
negative_2 = Negative(Value=multiplication_2)
multiplication_28 = Multiplication(A="3", B=Slider(11, range=0..40))
negative_3 = Negative(Value=multiplication_5)
negative_4 = Negative(Value=multiplication_7)
point_2 = Point(<point referenced from the Rhino model>)
point_3 = Point(<point referenced from the Rhino model>)
point_4 = Point(<point referenced from the Rhino model>)
point_5 = Point(<point referenced from the Rhino model>)
point_6 = Point(<point referenced from the Rhino model>)
point_7 = Point(<point referenced from the Rhino model>)
point_8 = Point(<point referenced from the Rhino model>)
point_9 = Point(<point referenced from the Rhino model>)
unit_y = UnitY(Factor=multiplication_10)
unit_y_2 = UnitY(Factor=multiplication_14)
unit_y_3 = UnitY(Factor=multiplication_18)
rectangle = Rectangle(Plane=point, XSize=multiplication_9, YSize=multiplication_10, Radius=0)  # -> Rectangle, Length
unit_y_4 = UnitY(Factor=multiplication_22)
unit_y_5 = UnitY(Factor=multiplication_24)
rectangle_2 = Rectangle(Plane=point_5, XSize=multiplication_13, YSize=multiplication_14, Radius=0)  # -> Rectangle, Length
rectangle_3 = Rectangle(Plane=point_2, XSize=negative, YSize=multiplication_3, Radius=0)  # -> Rectangle, Length
rectangle_4 = Rectangle(Plane=point_3, XSize=negative_2, YSize=multiplication_4, Radius=0)  # -> Rectangle, Length
rectangle_5 = Rectangle(Plane=point_6, XSize=negative_3, YSize=multiplication_6, Radius=0)  # -> Rectangle, Length
rectangle_6 = Rectangle(Plane=point_8, XSize=multiplication_17, YSize=multiplication_18, Radius=0)  # -> Rectangle, Length
rectangle_7 = Rectangle(Plane=point_9, XSize=negative_4, YSize=multiplication_8, Radius=0)  # -> Rectangle, Length
rectangle_8 = Rectangle(Plane=point_4, XSize=multiplication_21, YSize=multiplication_22, Radius=0)  # -> Rectangle, Length
rectangle_9 = Rectangle(Plane=point_7, XSize=multiplication_23, YSize=multiplication_24, Radius=0)  # -> Rectangle, Length
move = Move(Geometry=point, Motion=unit_y)  # -> Geometry, Transform
rectangle_10 = Rectangle(Plane=move.Geometry, XSize=multiplication_11, YSize=multiplication_12, Radius=0)  # -> Rectangle, Length
move_2 = Move(Geometry=point_5, Motion=unit_y_2)  # -> Geometry, Transform
rectangle_11 = Rectangle(Plane=move_2.Geometry, XSize=multiplication_15, YSize=multiplication_16, Radius=0)  # -> Rectangle, Length
move_3 = Move(Geometry=point_8, Motion=unit_y_3)  # -> Geometry, Transform
rectangle_12 = Rectangle(Plane=move_3.Geometry, XSize=multiplication_19, YSize=multiplication_20, Radius=0)  # -> Rectangle, Length
move_4 = Move(Geometry=point_4, Motion=unit_y_4)  # -> Geometry, Transform
rectangle_13 = Rectangle(Plane=move_4.Geometry, XSize=multiplication_25, YSize=multiplication_26, Radius=0)  # -> Rectangle, Length
move_5 = Move(Geometry=point_7, Motion=unit_y_5)  # -> Geometry, Transform
rectangle_14 = Rectangle(Plane=move_5.Geometry, XSize=multiplication_27, YSize=multiplication_28, Radius=0)  # -> Rectangle, Length
number_slider = Slider(21, range=20..40)
number_slider_2 = Slider(22, range=20..40)
number_slider_3 = Slider(22, range=20..40)
number_slider_4 = Slider(20, range=20..40)
merge = Merge(Data1=number_slider_2, Data2=number_slider_3, Data3=number_slider, Data4=number_slider_4)
merge_2 = Merge(Data1=rectangle_3.Rectangle, Data2=rectangle_4.Rectangle, Data3=rectangle_5.Rectangle, Data4=rectangle_7.Rectangle)
multiplication_29 = Multiplication(A="1.5", B=merge)
unit_z = UnitZ(Factor=multiplication_29)
number_slider_5 = Slider(30, range=25..30)
number_slider_6 = Slider(27, range=25..30)
number_slider_7 = Slider(25, range=25..30)
number_slider_8 = Slider(30, range=25..30)
number_slider_9 = Slider(30, range=25..30)
number_slider_10 = Slider(26, range=25..30)
number_slider_11 = Slider(25, range=25..30)
number_slider_12 = Slider(27, range=25..30)
number_slider_13 = Slider(25, range=25..30)
number_slider_14 = Slider(28, range=25..30)
extrude = Extrude(Base=merge_2, Direction=unit_z)
merge_3 = Merge(
    Data1=rectangle_6.Rectangle,
    Data2=rectangle_12.Rectangle,
    Data3=rectangle_9.Rectangle,
    Data4=rectangle_14.Rectangle,
    Data5=rectangle_8.Rectangle,
    Data6=rectangle_13.Rectangle,
    Data7=rectangle_2.Rectangle,
    Data8=rectangle_11.Rectangle,
    Data9=rectangle.Rectangle,
    Data10=rectangle_10.Rectangle)
cap_holes = CapHoles(Brep=extrude)
merge_4 = Merge(
    Data1=number_slider_8,
    Data2=number_slider_9,
    Data3=number_slider_7,
    Data4=number_slider_6,
    Data5=number_slider_5,
    Data6=number_slider_14,
    Data7=number_slider_10,
    Data8=number_slider_12,
    Data9=number_slider_13,
    Data10=number_slider_11)
multiplication_30 = Multiplication(A="1.5", B=merge_4)
unit_z_2 = UnitZ(Factor=multiplication_30)
extrude_2 = Extrude(Base=merge_3, Direction=unit_z_2)
cap_holes_2 = CapHoles(Brep=extrude_2)

# ----
# Gardens Option 1
brep = Brep([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])
brep_2 = Brep([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])
brep_3 = Brep([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])
brep_4 = Brep([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])
brep_5 = Brep([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])
brep_6 = Brep(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)
brep_7 = Brep([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])
brep_8 = Brep([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])
brep_9 = Brep([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])
brep_10 = Brep([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])
brep_11 = Brep([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])

# ----
# Gardens Option 2
brep_12 = Brep([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])
brep_13 = Brep([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])
brep_14 = Brep([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])
brep_15 = Brep([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])
brep_16 = Brep([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])
brep_17 = Brep([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])
brep_18 = Brep([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])
brep_19 = Brep()
brep_20 = Brep([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])
brep_21 = Brep()
brep_22 = Brep([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])

# ----
# Stage 00
geometry_option_one = Brep([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])
brep_23 = Brep([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])
brep_24 = Brep([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])
brep_25 = Brep([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])
brep_26 = Brep([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])
brep_27 = Brep([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])
brep_28 = Brep([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])
brep_29 = Brep([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])

# ----
# Massing Options 1
brep_30 = Brep([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])
brep_31 = Brep([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])
brep_32 = Brep([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])
brep_33 = Brep([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])
brep_34 = Brep([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])
brep_35 = Brep([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])
brep_36 = Brep([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])
brep_37 = Brep([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])
brep_38 = Brep([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])
brep_39 = Brep([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])
brep_40 = Brep([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])

# ----
# Massing Options 2
brep_41 = Brep([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])
brep_42 = Brep([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])
brep_43 = Brep([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])
brep_44 = Brep([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])
brep_45 = Brep([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])
brep_46 = Brep([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])
brep_47 = Brep([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])
brep_48 = Brep()
brep_49 = Brep([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])
brep_50 = Brep()
brep_51 = Brep([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])

# ----
# EPW SETUP
panel = Panel("https://www.energyplus.net/weather-download/europe_wmo_region_6/NLD//NLD_Amsterdam.062400_IWEC/all")
downloadepw = LBDownloadWeather(weather_URL=panel)  # -> epw_file, stat_file, ddy_file; plug-in component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
importepw = LBImportEPW(epw_file=downloadepw.epw_file)  # -> location, dry_bulb_temperature, dew_point_temperature, relative_humidity, wind_speed, wind_direction, direct_normal_rad, diffuse_horizontal_rad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; plug-in component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

weight_for_road = Slider(5, range=0..10)
weight_for_kop_grasweg = Slider(3, range=0..10)
number_slider_15 = Slider(10, range=0..10)
weight_for_ij = Slider(7, range=0..10)
# VISIBILITY ANALYSIS SETUP
ij_points = Curve(<curve referenced from the Rhino model>)
divide_distance = DivideDistance(Curve=ij_points, Distance=number_slider_15)  # -> Points, Tangents, Parameters
road_points = Curve(<curve referenced from the Rhino model>)
list_length = ListLength(List=divide_distance.Points)
divide_distance_2 = DivideDistance(Curve=road_points, Distance=number_slider_15)  # -> Points, Tangents, Parameters
geometry = Geometry(divide_distance.Points)
cop_grasweg_bridge = Point(<point referenced from the Rhino model>)
list_length_2 = ListLength(List=divide_distance_2.Points)
duplicate_data = DuplicateData(Data=weight_for_ij, Number=list_length, Order=True)
# SUN HOURS
# RADIATION ( FOR ENERGY)
# VISIBILITY
# ACCESS TO SKY(GARDENS)
# PRIVACY
# BUILT AREA / SUN HOURS
duplicate_data_2 = DuplicateData(Data=weight_for_road, Number=list_length_2, Order=True)
merge_5 = Merge(Data1=cop_grasweg_bridge, Data2=divide_distance.Points, Data3=divide_distance_2.Points)  # -> flatten(Result)
merge_6 = Merge(Data1=weight_for_kop_grasweg, Data2=duplicate_data, Data3=duplicate_data_2)  # -> flatten(Result)

# ----
# HOYS's
panel_2 = Panel("1")
series = Series(Start=panel_2, Step=1, Count="12")
series_2 = Series(Start="7", Step=1, Count="9")
hoy = LBCalculateHOY(month=graft(series), hour=series_2)  # -> flatten(hoy), flatten(doy), flatten(date); plug-in component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

# ----
# SUN PATH
vector_2pt = Vector2Pt(PointA=Point(-592.3114903, -235.3755788, 0), PointB=Point(-648.4559105, -199.5409801, 0), Unitize=False)  # -> Vector, Length
point_10 = Point(Point(149.4275346, -436.3937473, 0))
sunpath = LBSunPath(north=vector_2pt.Vector, location=importepw.location, hoys=hoy.hoy, center_pt=point_10, scale=1)  # -> report, vectors, altitudes, azimuths, hoys, sun_pts, analemma, daily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; plug-in component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

number_slider_16 = Slider(3, range=0..10)  # disabled
# ACCESS TO SKY
number_slider_17 = Slider(5, range=0..10)

# ----
# INPUT BREPS
# MASSING BREP
brep_52 = Brep([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])
# GARDEN BREP
brep_53 = Brep([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])

brep_54 = Brep([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])  # disabled
brep_55 = Brep([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])  # disabled
brep_56 = Brep([cap_holes_2, cap_holes])

# ----
# RADIATION ANALYSIS
skymatrix = LBCumulativeSkyMatrix(
    north=vector_2pt.Vector,
    location=importepw.location,
    direct_rad=importepw.direct_normal_rad,
    diffuse_rad=importepw.diffuse_horizontal_rad,
    hoys=hoy.hoy)  # -> out, sky_mtx; plug-in component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
context = Brep([<brep referenced from the Rhino model> x15])
run_it = BooleanToggle(False)
incidentradiation = LBIncidentRadiation(
    sky_mtx=skymatrix.sky_mtx,
    geometry=flatten(brep_56),
    context=flatten(context),
    grid_size=Slider(1, range=0..1),
    offset_dist=Slider(0.01, range=0..0.01),
    parallel=run_it,
    run=run_it)  # -> out, points, results, total, mesh, legend, title, int_mtx; plug-in component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

# ----
# PRIVACY
genpts = LBGeneratePointGrid(geometry=brep_56, grid_size=number_slider_16)  # -> points, vectors, face_areas, graft(mesh); disabled; plug-in component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

number_slider_18 = Slider(1, range=0..1)
geo_block = BooleanToggle(True)
run_it_2 = BooleanToggle(True)
# VISIBILITY ANALYSIS
context_2 = Brep([<brep referenced from the Rhino model> x15])
visibilitypercent = LBVisibilityPercent(
    view_points=merge_5,
    pt_weights=merge_6,
    geometry=flatten(brep_56),
    context=flatten(context_2),
    grid_size=number_slider_17,
    offset_dist=Slider(0.01, range=0..0.01),
    geo_block=geo_block,
    run=run_it_2)  # -> report, points, flatten(results), mesh, legend, title, int_mtx; plug-in component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

brep_57 = Brep([<brep referenced from the Rhino model> x5])

number_slider_19 = Slider(1, range=0..1)
# GREEN-BUILDING RATIO
boolean_toggle = BooleanToggle(True)
viewpercent = LBViewPercent(
    view_type=Slider(3, range=0..10),
    geometry=flatten(brep_57),
    context=flatten(brep_56),
    grid_size=number_slider_17,
    offset_dist=Slider(0.01, range=0..0.01),
    geo_block=boolean_toggle,
    parallel=boolean_toggle,
    run=boolean_toggle)  # -> out, points, view_vecs, results, mesh, legend, title, int_mtx; plug-in component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

panel_3 = Panel(brep_57)
custom_preview = CustomPreview(Geometry=brep_56, Material=ColourSwatch(SwatchColor=RGB(165, 247, 255)))  # disabled
number_slider_20 = Slider(44, range=0..100)  # disabled
deconstruct = Deconstruct(Point=genpts.points)  # -> XComponent, YComponent, ZComponent; disabled
larger_than = LargerThan(FirstNumber=deconstruct.ZComponent, SecondNumber=number_slider_20)  # -> LargerThan, OrEqualTo; disabled

equality = Equality(FirstNumber=visibilitypercent.results, SecondNumber="0")  # -> Equality, Inequality
cull_pattern = CullPattern(List=visibilitypercent.results, CullPattern=invert(equality.Equality))
mass_addition = MassAddition(Input=flatten(visibilitypercent.results))  # -> flatten(Result), PartialResults
average = Average(Input=cull_pattern)  # -> flatten(ArithmeticMean)
panel_4 = Panel(mass_addition.Result)
panel_5 = Panel(average)

# ----
# SUN-LIGHT HOURS ANALYSIS
# VISIBILITY ANALYSIS  RESULTS
list_length_3 = ListLength(List=brep_56)
duplicate_data_3 = DuplicateData(Data=brep_56, Number=list_length_3, Order=True)
series_3 = Series(Start=0, Step=1, Count=list_length_3)
multiplication_31 = Multiplication(A=series_3, B=4)
number_slider_21 = Slider(1, range=0..1)
cull_index = CullIndex(List=duplicate_data_3, Indices=multiplication_31, Wrap=True)
partition_list = PartitionList(List=cull_index, Size=expr("x-1", list_length_3))  # -> simplify(Chunks)
directsunhours = LBDirectSunHours(
    vectors=flatten(sunpath.vectors),
    geometry=graft(brep_56),
    context=partition_list,
    grid_size=number_slider_17,
    run=Toggle(True))  # -> report, points, results, mesh, legend, title, int_mtx; plug-in component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

# ----
# ACCESS TO SKY RESULTS
equality_2 = Equality(FirstNumber=viewpercent.results, SecondNumber="0")  # -> Equality, Inequality
cull_pattern_2 = CullPattern(List=viewpercent.results, CullPattern=invert(equality_2.Equality))
average_2 = Average(Input=cull_pattern_2)  # -> flatten(ArithmeticMean)
panel_6 = Panel(average_2)

cull_pattern_3 = CullPattern(List=genpts.points, CullPattern=invert(larger_than.LargerThan))  # disabled
mass_addition_2 = MassAddition(Input=incidentradiation.results)  # -> flatten(Result), PartialResults
geometry_2 = Geometry(incidentradiation.mesh)
param_viewer = ParamViewer(cull_pattern_3)  # disabled
list_item = ListItem(List=param_viewer, Index=0, Wrap=True)  # disabled
tree_branch = TreeBranch(Tree=cull_pattern_3, Path=list_item, MaintainPaths=True)  # disabled
visibilitypercent_2 = LBVisibilityPercent()  # -> report, points, flatten(results), mesh, legend, title, int_mtx; disabled; plug-in component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

# ----
# SUN-LIGHT HOURS ANALYSIS  RESULTS
mass_addition_3 = MassAddition(Input=flatten(directsunhours.results))  # -> Result, PartialResults
equality_3 = Equality(FirstNumber=directsunhours.results, SecondNumber="0")  # -> Equality, Inequality
cull_pattern_4 = CullPattern(List=directsunhours.results, CullPattern=invert(equality_3.Equality))
average_3 = Average(Input=flatten(cull_pattern_4))  # -> flatten(ArithmeticMean)
panel_7 = Panel(average_3)

unit_z_3 = UnitZ(Factor=1)
floor_height = Slider(3, range=0..10)
point_11 = Point(<point referenced from the Rhino model>)
move_6 = Move(Geometry=point_11, Motion=unit_z_3)  # -> Geometry, Transform
vector_2pt_2 = Vector2Pt(PointA=point_11, PointB=move_6.Geometry, Unitize=False)  # -> Vector, Length
contour = Contour(Shape=brep_57, Point=point_11, Direction=vector_2pt_2.Vector, Distance=Slider(1, range=0..1))
contour_2 = Contour(Shape=flatten(brep_56), Point=point_11, Direction=vector_2pt_2.Vector, Distance=floor_height)
shift_paths = ShiftPaths(Data=contour, Offset=-1)
area = Area(Geometry=contour_2)  # -> Area, Centroid
list_item_2 = ListItem(List=simplify(shift_paths), Index="0", Wrap=True)
mass_addition_4 = MassAddition(Input=flatten(area.Area))  # -> Result, PartialResults
area_2 = Area(Geometry=list_item_2)  # -> Area, Centroid
mass_addition_5 = MassAddition(Input=flatten(area.Area))  # -> Result, PartialResults
mass_addition_6 = MassAddition(Input=flatten(area_2.Area))  # -> Result, PartialResults
division = Division(A=mass_addition_5.Result, B=mass_addition_6.Result)
division_2 = Division(A=mass_addition_3.Result, B=mass_addition_4.Result)

# ----
# SUNLIGHT-HOURS ON FACADES TO FLOOR AREA RATIO
division_3 = Division(A=mass_addition_4.Result, B=mass_addition_3.Result)
multiplication_32 = Multiplication(A=division_3, B=100)
panel_9 = Panel(multiplication_32)

division_4 = Division(A="113760", B=mass_addition_4.Result)
multiplication_33 = Multiplication(A=division_4, B=100)
sun_floor = Slider(8, range=0..10)
floor_area = Slider(4, range=0..10)
sun_hours = Slider(9, range=0..10)
visbility = Slider(7, range=0..10)
access_to_sky = Slider(7, range=0..10)
merge_7 = Merge(Data1=mass_addition_3.Result, Data2=average)
panel_10 = Panel(merge_7)
division_5 = Division(A=sun_floor, B="10")
division_6 = Division(A=floor_area, B="10")
division_7 = Division(A=access_to_sky, B="10")
division_8 = Division(A=visbility, B="10")
division_9 = Division(A=sun_hours, B="10")
access_to_sky_2 = Slider(7, range=0..10)
visbility_2 = Slider(7, range=0..10)
sun_hours_2 = Slider(9, range=0..10)
multiplication_34 = Multiplication(A=division_8, B=average)
multiplication_35 = Multiplication(A=division_9, B=average_3)
multiplication_36 = Multiplication(A=division_7, B=average_2)
multiplication_37 = Multiplication(A=division_6, B=panel_9)
merge_8 = Merge(Data1=multiplication_35, Data2=multiplication_34, Data3=multiplication_36)
data = Data(sun_hours_2)
data_2 = Data(visbility_2)
data_3 = Data()
average_4 = Average(Input=flatten(merge_8))  # -> flatten(ArithmeticMean)
mass_addition_7 = MassAddition(Input=merge_8)  # -> Result, PartialResults
file_path = FilePath("D:\TU_Delft\Msc_Building_Technology\Semester_3\Graduation\Prof Thijs\Scale02\")
captureview = LBCaptureView(file_name=average_4, folder=file_path, viewport="Isometric_for_analysis", capture=Toggle(True))  # -> Output; plug-in component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
panel_11 = Panel(mass_addition_7.Result)
panel_12 = Panel(average_4)

# ----
# CUMULATIVE RESULTS
panel_13 = Panel("SUNHOURS")
merge_9 = Merge(
    Data1=panel_13,
    Data2=mass_addition_3.Result,
    Data3="VISBILITY",
    Data4=average,
    Data5="ACCESS TO SKY GARDENS",
    Data6=average_2,
    Data7="AREA OF GARDENS",
    Data8=mass_addition_6.Result,
    Data9="FLOOR AREA",
    Data10=mass_addition_5.Result,
    Data11="SUN HOURS/FLOOR AREA",
    Data12=division_2,
    Data13="FLOOR AREA/AREA OF GARDENS",
    Data14=division,
    Data15="TOTAL/RADIATION",
    Data16=mass_addition_2.Result,
    Data17="SUN_HOURS TO FLOOR AREA",
    Data18=multiplication_32)
panel_14 = Panel(merge_9)

brep_58 = Brep([<brep referenced from the Rhino model> x10])
galapagos = Galapagos(
    fitness=average_4,
    gene=[number_slider_8, number_slider_9, number_slider_7, number_slider_6, number_slider_5, number_slider_14, number_slider_10, number_slider_12, number_slider_13, number_slider_11, number_slider_2, number_slider_3, number_slider, number_slider_4])
deconstruct_brep = DeconstructBrep(Brep=graft(brep_58))  # -> Faces, Edges, Vertices
voxelizer = Voxelizer(Mesh=graft(brep_58), Size=Slider(3, range=0..10))  # -> Voxels, Points
deconstruct_2 = Deconstruct(Point=deconstruct_brep.Vertices)  # -> XComponent, YComponent, ZComponent
equality_4 = Equality(FirstNumber=deconstruct_2.ZComponent, SecondNumber="0")  # -> Equality, Inequality
cull_pattern_5 = CullPattern(List=deconstruct_2.ZComponent, CullPattern=equality_4.Inequality)
list_item_3 = ListItem(List=cull_pattern_5, Index=0, Wrap=True)
division_10 = Division(A=list_item_3, B=Slider(3, range=0..10))
panel_15 = Panel(list_item_3)
round = Round(Number=division_10)  # -> Nearest, Floor, Ceiling
panel_16 = Panel(round.Floor)
number_slider_22 = Slider(3, range=0..10)
data_4 = Data(["SUNHOURS", 2427830, "VISBILITY", 29.440731, "ACCESS TO SKY GARDENS", 35.38054866, "AREA OF GARDENS", 5151.721645, "FLOOR AREA", 103500, "SUN HOURS/FLOOR AREA", 23.45729469, "FLOOR AREA/AREA OF GARDENS", 20.09037117, "TOTAL/RADIATION", 652732.6673, "SUN_HOURS TO FLOOR AREA", 4.263066195])
data_5 = Data(["SUNHOURS", 3711793, "VISBILITY", 35.35748507, "ACCESS TO SKY GARDENS", 31.55883412, "AREA OF GARDENS", 5294.06199, "FLOOR AREA", 181807.0063, "SUN HOURS/FLOOR AREA", 20.41611638, "FLOOR AREA/AREA OF GARDENS", 34.34168444, "TOTAL/RADIATION", 1030795.07, "SUN_HOURS TO FLOOR AREA", 4.8980912])
data_6 = Data(["SUNHOURS", 3294189, "VISBILITY", 38.06357337, "ACCESS TO SKY GARDENS", 21.87577488, "AREA OF GARDENS", 3318.618013, "FLOOR AREA", 156118.9581, "SUN HOURS/FLOOR AREA", 21.10050592, "FLOOR AREA/AREA OF GARDENS", 47.0433649, "TOTAL/RADIATION", 896884.7158, "SUN_HOURS TO FLOOR AREA", 4.739222859])
data_7 = Data(["SUNHOURS", 2378246, "VISBILITY", 31.89223458, "ACCESS TO SKY GARDENS", 28.03350694, "AREA OF GARDENS", 4585.418988, "FLOOR AREA", 126561.2291, "SUN HOURS/FLOOR AREA", 18.7912682, "FLOOR AREA/AREA OF GARDENS", 27.60079929, "TOTAL/RADIATION", 671390.7268, "SUN_HOURS TO FLOOR AREA", 5.321620604])
data_8 = Data(["SUNHOURS", 2562197, "VISBILITY", 34.14306806, "ACCESS TO SKY GARDENS", 51.80250557, "AREA OF GARDENS", 5287.897776, "FLOOR AREA", 132069, "SUN HOURS/FLOOR AREA", 19.40044219, "FLOOR AREA/AREA OF GARDENS", 24.97570974, "TOTAL/RADIATION", 667882.0657, "SUN_HOURS TO FLOOR AREA", 5.154521686])
data_9 = Data(["SUNHOURS", 2231702, "VISBILITY", 32.29472065, "ACCESS TO SKY GARDENS", 47.50184316, "AREA OF GARDENS", 4343.947759, "FLOOR AREA", 119300, "SUN HOURS/FLOOR AREA", 18.70663873, "FLOOR AREA/AREA OF GARDENS", 27.46349786, "TOTAL/RADIATION", 607209.157, "SUN_HOURS TO FLOOR AREA", 5.345695796])
data_10 = Data(["SUNHOURS", 2168065, "VISBILITY", 30.73982227, "ACCESS TO SKY GARDENS", 44.97181072, "AREA OF GARDENS", 5350.86478, "FLOOR AREA", 125167.5, "SUN HOURS/FLOOR AREA", 17.32130945, "FLOOR AREA/AREA OF GARDENS", 23.39201328, "TOTAL/RADIATION", 601877.7314, "SUN_HOURS TO FLOOR AREA", 5.773235581])
data_11 = Data(["SUNHOURS", 2217130, "VISBILITY", 37.62981714, "ACCESS TO SKY GARDENS", 50.57816896, "AREA OF GARDENS", 3697.97176, "FLOOR AREA", 98662.76534, "SUN HOURS/FLOOR AREA", 22.47180071, "FLOOR AREA/AREA OF GARDENS", 26.68023764, "TOTAL/RADIATION", 561108.6921, "SUN_HOURS TO FLOOR AREA", 4.450021665])
data_12 = Data(["SUNHOURS", 2956525, "VISBILITY", 35.77920703, "ACCESS TO SKY GARDENS", 46.93536652, "AREA OF GARDENS", 3565.056025, "FLOOR AREA", 152652, "SUN HOURS/FLOOR AREA", 19.36774494, "FLOOR AREA/AREA OF GARDENS", 42.81896243, "TOTAL/RADIATION", 756406.8995, "SUN_HOURS TO FLOOR AREA", 5.163223717])
data_13 = Data(["SUNHOURS", 2050428, "VISBILITY", 24.68365674, "ACCESS TO SKY GARDENS", 33.77312725, "AREA OF GARDENS", 8190.797808, "FLOOR AREA", 64290, "SUN HOURS/FLOOR AREA", 31.89342044, "FLOOR AREA/AREA OF GARDENS", 7.849052254, "TOTAL/RADIATION", 569935.3889, "SUN_HOURS TO FLOOR AREA", 3.135442942])
data_14 = Data(["SUNHOURS", 2388181, "VISBILITY", 38.81634883, "ACCESS TO SKY GARDENS", 48.85010601, "AREA OF GARDENS", 6970.926252, "FLOOR AREA", 94902, "SUN HOURS/FLOOR AREA", 25.16470675, "FLOOR AREA/AREA OF GARDENS", 13.61397275, "TOTAL/RADIATION", 595270.6974, "SUN_HOURS TO FLOOR AREA", 3.973819405])
data_15 = Data(["SUNHOURS", 2501176, "VISBILITY", 36.30247918, "ACCESS TO SKY GARDENS", 44.33745951, "AREA OF GARDENS", 4039.213268, "FLOOR AREA", 154560, "SUN HOURS/FLOOR AREA", 16.18255694, "FLOOR AREA/AREA OF GARDENS", 38.26487728, "TOTAL/RADIATION", 646492.3682, "SUN_HOURS TO FLOOR AREA", 6.179493166])
data_16 = Data(["SUNHOURS", 1920341, "VISBILITY", 28.92039027, "ACCESS TO SKY GARDENS", 32.334249, "AREA OF GARDENS", 7263.72984, "FLOOR AREA", 65565.18299, "SUN HOURS/FLOOR AREA", 29.28903592, "FLOOR AREA/AREA OF GARDENS", 9.02637962, "TOTAL/RADIATION", 536987.0349, "SUN_HOURS TO FLOOR AREA", 3.414246896])
data_17 = Data(["SUNHOURS", 2744259, "VISBILITY", 39.17015747, "ACCESS TO SKY GARDENS", 54.60398907, "AREA OF GARDENS", 5381.723948, "FLOOR AREA", 167913, "SUN HOURS/FLOOR AREA", 16.34333851, "FLOOR AREA/AREA OF GARDENS", 31.20059699, "TOTAL/RADIATION", 721842.4195, "SUN_HOURS TO FLOOR AREA", 6.118700895])
data_18 = Data(["SUNHOURS", 2643875, "VISBILITY", 38.27459269, "ACCESS TO SKY GARDENS", 28.11372725, "AREA OF GARDENS", 5117.582405, "FLOOR AREA", 116149.3325, "SUN HOURS/FLOOR AREA", 22.76272229, "FLOOR AREA/AREA OF GARDENS", 22.69613332, "TOTAL/RADIATION", 656069.1736, "SUN_HOURS TO FLOOR AREA", 4.393147654])
data_19 = Data(["SUNHOURS", 2006767, "VISBILITY", 30.38361518, "ACCESS TO SKY GARDENS", 27.410417, "AREA OF GARDENS", 6559.122162, "FLOOR AREA", 76681.09249, "SUN HOURS/FLOOR AREA", 26.17029746, "FLOOR AREA/AREA OF GARDENS", 11.69075535, "TOTAL/RADIATION", 554855.4267, "SUN_HOURS TO FLOOR AREA", 3.821125845])
data_20 = Data(["SUNHOURS", 2197174, "VISBILITY", 35.46663175, "ACCESS TO SKY GARDENS", 45.86109373, "AREA OF GARDENS", 5529.291809, "FLOOR AREA", 103688.8896, "SUN HOURS/FLOOR AREA", 21.190062, "FLOOR AREA/AREA OF GARDENS", 18.75265282, "TOTAL/RADIATION", 572853.706, "SUN_HOURS TO FLOOR AREA", 4.719193365])
data_21 = Data(["SUNHOURS", 2528983, "VISBILITY", 24.31669344, "ACCESS TO SKY GARDENS", 29.85301476, "AREA OF GARDENS", 4734.351846, "FLOOR AREA", 113400, "SUN HOURS/FLOOR AREA", 22.30143739, "FLOOR AREA/AREA OF GARDENS", 23.95259239, "TOTAL/RADIATION", 649484.7722, "SUN_HOURS TO FLOOR AREA", 4.484015907])
data_22 = Data(["SUNHOURS", 2638307, "VISBILITY", 36.76887182, "ACCESS TO SKY GARDENS", 22.88014188, "AREA OF GARDENS", 5237.448584, "FLOOR AREA", 121884, "SUN HOURS/FLOOR AREA", 21.6460487, "FLOOR AREA/AREA OF GARDENS", 23.27163657, "TOTAL/RADIATION", 709585.7985, "SUN_HOURS TO FLOOR AREA", 4.619780791])
data_23 = Data(["SUNHOURS", 2620071, "VISBILITY", 35.64965459, "ACCESS TO SKY GARDENS", 15.42496497, "AREA OF GARDENS", 2686.363933, "FLOOR AREA", 127173.6027, "SUN HOURS/FLOOR AREA", 20.60231796, "FLOOR AREA/AREA OF GARDENS", 47.3404222, "TOTAL/RADIATION", 683523.6577, "SUN_HOURS TO FLOOR AREA", 4.853822768])
series_4 = Series(Start=number_slider_22, Step=number_slider_22, Count=round.Floor)
construct_point = ConstructPoint(XCoordinate=deconstruct_2.XComponent, YCoordinate=deconstruct_2.YComponent, ZCoordinate=series_4)
merge_10 = Merge(
    Data1=data_4,
    Data2=data_5,
    Data3=data_6,
    Data4=data_7,
    Data5=data_10,
    Data6=data_11,
    Data7=data_12,
    Data8=data_8,
    Data9=data_14,
    Data10=data_16,
    Data11=data_19,
    Data12=data_21,
    Data13=data_23,
    Data14=data_20,
    Data15=data_22,
    Data16=data_17,
    Data17=data_9,
    Data18=data_18,
    Data19=data_15,
    Data20=data_13)
panel_17 = Panel("B2/((B2^2)+(B3^2)+(B4^2)+(B5^2)+(B6^2)+(B7^2)+(B8^2)+(B9^2))^0,5")
list_length_4 = ListLength(List=data_4)
# Normalised Matrix
partition_list_2 = PartitionList(List=merge_10, Size=list_length_4)
data_24 = Data(["SUNHOURS", 2217130, "VISBILITY", 37.62981714, "ACCESS TO SKY GARDENS", 50.57816896, "AREA OF GARDENS", 3697.97176, "FLOOR AREA", 98662.76534, "SUN HOURS/FLOOR AREA", 22.47180071, "FLOOR AREA/AREA OF GARDENS", 26.68023764, "TOTAL/RADIATION", 561108.6921, "SUN_HOURS TO FLOOR AREA", 4.450021665])
number_slider_23 = Slider(0, range=0..18)
number_slider_24 = Slider(4, range=0..18)
number_slider_25 = Slider(2, range=0..18)
number_slider_26 = Slider(8, range=0..18)
number_slider_27 = Slider(6, range=0..18)
number_slider_28 = Slider(10, range=0..18)
number_slider_29 = Slider(12, range=0..18)
number_slider_30 = Slider(14, range=0..18)
number_slider_31 = Slider(16, range=0..18)
list_item_4 = ListItem(List=partition_list_2, Index=number_slider_23, Wrap=True)
list_item_5 = ListItem(List=partition_list_2, Index=Slider(1, range=0..18), Wrap=True)
list_item_6 = ListItem(List=partition_list_2, Index=number_slider_24, Wrap=True)
list_item_7 = ListItem(List=partition_list_2, Index=number_slider_25, Wrap=True)
list_item_8 = ListItem(List=partition_list_2, Index=number_slider_26, Wrap=True)
list_item_9 = ListItem(List=partition_list_2, Index=number_slider_28, Wrap=True)
list_item_10 = ListItem(List=partition_list_2, Index=Slider(5, range=0..18), Wrap=True)
list_item_11 = ListItem(List=partition_list_2, Index=number_slider_27, Wrap=True)
list_item_12 = ListItem(List=partition_list_2, Index=Slider(3, range=0..18), Wrap=True)
list_item_13 = ListItem(List=partition_list_2, Index=number_slider_29, Wrap=True)
list_item_14 = ListItem(List=partition_list_2, Index=Slider(9, range=0..18), Wrap=True)
list_item_15 = ListItem(List=partition_list_2, Index=Slider(11, range=0..18), Wrap=True)
list_item_16 = ListItem(List=partition_list_2, Index=Slider(7, range=0..18), Wrap=True)
list_item_17 = ListItem(List=partition_list_2, Index=Slider(13, range=0..18), Wrap=True)
list_item_18 = ListItem(List=partition_list_2, Index=number_slider_30, Wrap=True)
list_item_19 = ListItem(List=partition_list_2, Index=number_slider_31, Wrap=True)
list_item_20 = ListItem(List=partition_list_2, Index=Slider(15, range=0..18), Wrap=True)
list_item_21 = ListItem(List=partition_list_2, Index=Slider(17, range=0..18), Wrap=True)
list_item_22 = ListItem(List=flatten(list_item_4), Index=number_slider_23, Wrap=True)
list_item_23 = ListItem(List=flatten(list_item_6), Index=number_slider_24, Wrap=True)
flatten_tree = FlattenTree(Tree=list_item_5, Path="{0}")
list_item_24 = ListItem(List=flatten(list_item_7), Index=number_slider_25, Wrap=True)
list_item_25 = ListItem(List=flatten(list_item_8), Index=number_slider_26, Wrap=True)
list_item_26 = ListItem(List=flatten(list_item_9), Index=number_slider_28, Wrap=True)
list_item_27 = ListItem(List=flatten(list_item_11), Index=number_slider_27, Wrap=True)
flatten_tree_2 = FlattenTree(Tree=list_item_10, Path="{0}")
flatten_tree_3 = FlattenTree(Tree=list_item_12, Path="{0}")
list_item_28 = ListItem(List=flatten(list_item_13), Index=number_slider_29, Wrap=True)
flatten_tree_4 = FlattenTree(Tree=list_item_14, Path="{0}")
flatten_tree_5 = FlattenTree(Tree=list_item_15, Path="{0}")
flatten_tree_6 = FlattenTree(Tree=list_item_16, Path="{0}")
flatten_tree_7 = FlattenTree(Tree=list_item_17, Path="{0}")
list_item_29 = ListItem(List=flatten(list_item_18), Index=number_slider_30, Wrap=True)
list_item_30 = ListItem(List=flatten(list_item_19), Index=number_slider_31, Wrap=True)
flatten_tree_8 = FlattenTree(Tree=list_item_20, Path="{0}")
flatten_tree_9 = FlattenTree(Tree=list_item_21, Path="{0}")
panel_18 = Panel(flatten_tree)
panel_19 = Panel(flatten_tree_2)
panel_20 = Panel(flatten_tree_3)
panel_21 = Panel(list_item_24)
panel_22 = Panel(flatten_tree_4)
panel_23 = Panel(flatten_tree_6)
panel_24 = Panel(flatten_tree_5)
panel_25 = Panel(list_item_22)
panel_26 = Panel(flatten_tree_7)
panel_27 = Panel(list_item_28)
panel_28 = Panel(list_item_23)
panel_29 = Panel(flatten_tree_8)
panel_30 = Panel(list_item_27)
panel_31 = Panel(list_item_26)
panel_32 = Panel(list_item_30)
panel_33 = Panel(flatten_tree_9)
panel_34 = Panel(list_item_25)
panel_35 = Panel(list_item_29)
merge_11 = Merge(Data1=panel_25, Data2=panel_18)
merge_12 = Merge(Data1=panel_21, Data2=panel_20)
merge_13 = Merge(Data1=panel_28, Data2=panel_19)
merge_14 = Merge(Data1=panel_30, Data2=panel_23)
merge_15 = Merge(Data1=panel_34, Data2=panel_22)
merge_16 = Merge(Data1=panel_27, Data2=panel_26)
brep_59 = Brep([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])
brep_60 = Brep([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])
merge_17 = Merge(Data1=panel_31, Data2=panel_24)
brep_61 = Brep([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])
brep_62 = Brep([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])
brep_63 = Brep([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])
brep_64 = Brep([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])
brep_65 = Brep([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])
brep_66 = Brep([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])
brep_67 = Brep([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])
brep_68 = Brep([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])
brep_69 = Brep([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])
brep_70 = Brep([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])
brep_71 = Brep([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])
brep_72 = Brep([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])
brep_73 = Brep([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])
brep_74 = Brep([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])
brep_75 = Brep([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])
brep_76 = Brep([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])
merge_18 = Merge(Data1=panel_35, Data2=panel_29)
brep_77 = Brep([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])
brep_78 = Brep([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])
merge_19 = Merge(Data1=panel_32, Data2=panel_33)
brep_79 = Brep([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])
brep_80 = Brep([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])
brep_81 = Brep([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])
brep_82 = Brep([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])
brep_83 = Brep([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])
brep_84 = Brep([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])
brep_85 = Brep([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])
brep_86 = Brep([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])
brep_87 = Brep([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])
brep_88 = Brep(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)
brep_89 = Brep([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])
brep_90 = Brep([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])
brep_91 = Brep([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])
brep_92 = Brep([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])
brep_93 = Brep([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])
brep_94 = Brep([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])
brep_95 = Brep([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])
brep_96 = Brep([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])
brep_97 = Brep([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])
brep_98 = Brep([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])
merge_20 = Merge(
    Data1=graft(merge_11),
    Data2=graft(merge_12),
    Data3=graft(merge_13),
    Data4=graft(merge_14),
    Data5=graft(merge_15),
    Data6=graft(merge_17),
    Data7=graft(merge_16),
    Data8=graft(merge_18),
    Data9=graft(merge_19))
list_length_5 = ListLength(List=brep_64)
list_length_6 = ListLength(List=brep_67)
list_length_7 = ListLength(List=brep_65)
list_length_8 = ListLength(List=brep_63)
list_length_9 = ListLength(List=brep_59)
list_length_10 = ListLength(List=brep_61)
list_length_11 = ListLength(List=brep_62)
list_length_12 = ListLength(List=brep_66)
list_length_13 = ListLength(List=brep_60)
list_length_14 = ListLength(List=brep_75)
list_length_15 = ListLength(List=brep_70)
list_length_16 = ListLength(List=brep_74)
list_length_17 = ListLength(List=brep_69)
list_length_18 = ListLength(List=brep_68)
list_length_19 = ListLength(List=brep_71)
flip_matrix = FlipMatrix(Data=merge_20)
list_length_20 = ListLength(List=brep_76)
list_length_21 = ListLength(List=brep_72)
list_length_22 = ListLength(List=brep_73)
list_length_23 = ListLength(List=brep_77)
list_length_24 = ListLength(List=brep_78)
file_path_2 = FilePath("D:\TU_Delft\Msc_Building_Technology\Semester_3\Graduation\Prof Thijs\Scale01\Data from Gh.xlsx")

option_one = Panel("2696871")
geometry_option_one_2 = Brep([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])  # disabled
option_two = Panel("2920563")
brep_99 = Brep([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])  # disabled
option_three = Panel("3132236")
brep_100 = Brep([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])  # disabled
option_four = Panel("3061037")
brep_101 = Brep([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])  # disabled
option_five = Panel("3035352")
brep_102 = Brep([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])  # disabled
option_six = Panel("2996278")
brep_103 = Brep([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])  # disabled
option_seven = Panel("3099893")
brep_104 = Brep([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])  # disabled
option_eight = Panel("3017407")
brep_105 = Brep([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])  # disabled
number = Number([1824300, 1813200, 1944500, 2023500, 1980900, 1956100, 1924600, 1941200])
merge_21 = Merge(
    Data1=option_one,
    Data2=option_two,
    Data3=option_three,
    Data4=option_four,
    Data5=option_five,
    Data6=option_six,
    Data7=option_seven,
    Data8=option_eight)
panel_36 = Panel(merge_21)
number_2 = Number([2696871, 2920563, 3132236, 3061037, 3035352, 2996278, 3099893, 3017407])
merge_22 = Merge(Data1=panel_36, Data2=number)

excelwrite = ExcelWrite(ExcelFile=file_path_2, Connect=Toggle(False), Sheet1=flip_matrix)
evaluate = Evaluate()
list_length_25 = ListLength(List=brep_79)
list_length_26 = ListLength(List=brep_80)
list_length_27 = ListLength(List=brep_81)
list_length_28 = ListLength(List=brep_82)
list_length_29 = ListLength(List=brep_83)
list_length_30 = ListLength(List=brep_84)
list_length_31 = ListLength(List=brep_85)
list_length_32 = ListLength(List=brep_86)
list_length_33 = ListLength(List=brep_88)
list_length_34 = ListLength(List=brep_87)
list_length_35 = ListLength(List=brep_89)
list_length_36 = ListLength(List=brep_90)
list_length_37 = ListLength(List=brep_94)
list_length_38 = ListLength(List=brep_93)
list_length_39 = ListLength(List=brep_91)
list_length_40 = ListLength(List=brep_96)
list_length_41 = ListLength(List=brep_98)
list_length_42 = ListLength(List=brep_97)
list_length_43 = ListLength(List=brep_92)
list_length_44 = ListLength(List=brep_95)
square = Square()
panel_37 = Panel("""0.49840534244749907
0.5390079665860319
0.3712911520760497
0.409110120319819
0.4904048879853061
0.45990677355368514
0.422434766915811
0.5413147702752414
0.6110807972936226
0.5454319270489574
0.5172856428876941
0.4415503954808691
0.2527388992498656
0.5291940302875471
0.47168116400030247
0.542986187989989
0.45494059707227225
0.4871575020885584
0.41553609909137545
0.569329684993132""")
panel_38 = Panel(flip_matrix)
merge_23 = Merge(
    Data1=brep_67,
    Data2=brep_59,
    Data3=brep_62,
    Data4=brep_61,
    Data5=brep_64,
    Data6=brep_65,
    Data7=brep_66,
    Data8=brep_60,
    Data9=brep_63,
    Data10=brep_74,
    Data11=brep_75,
    Data12=brep_70,
    Data13=brep_68,
    Data14=brep_69,
    Data15=brep_72,
    Data16=brep_71,
    Data17=brep_76,
    Data18=brep_73,
    Data19=brep_78,
    Data20=brep_77)
merge_24 = Merge(
    Data1=list_length_6,
    Data2=list_length_9,
    Data3=list_length_11,
    Data4=list_length_10,
    Data5=list_length_5,
    Data6=list_length_7,
    Data7=list_length_12,
    Data8=list_length_13,
    Data9=list_length_8,
    Data10=list_length_16,
    Data11=list_length_14,
    Data12=list_length_15,
    Data13=list_length_18,
    Data14=list_length_17,
    Data15=list_length_21,
    Data16=list_length_19,
    Data17=list_length_20,
    Data18=list_length_22,
    Data19=list_length_24,
    Data20=list_length_23)
merge_25 = Merge(
    Data1=brep_79,
    Data2=brep_80,
    Data3=brep_81,
    Data4=brep_82,
    Data5=brep_83,
    Data6=brep_84,
    Data7=brep_85,
    Data8=brep_86,
    Data9=brep_88,
    Data10=brep_87,
    Data11=brep_89,
    Data12=brep_90,
    Data13=brep_93,
    Data14=brep_94,
    Data15=brep_91,
    Data16=brep_92,
    Data17=brep_95,
    Data18=brep_97,
    Data19=brep_96,
    Data20=brep_98)
merge_26 = Merge(
    Data1=list_length_25,
    Data2=list_length_26,
    Data3=list_length_27,
    Data4=list_length_28,
    Data5=list_length_29,
    Data6=list_length_30,
    Data7=list_length_31,
    Data9=list_length_32,
    Data10=list_length_33,
    Data11=list_length_34,
    Data12=list_length_35,
    Data13=list_length_36,
    Data14=list_length_38,
    Data15=list_length_37,
    Data16=list_length_39,
    Data17=list_length_43,
    Data18=list_length_44,
    Data19=list_length_42,
    Data20=list_length_40,
    Data21=list_length_41)
panel_39 = Panel("""9
6
19
18
10
13
16
5
1
3
8
15
20
7
12
4
14
11
17
2""")
round_to_decimal_place = RoundToDecimalPlace(NumberX=panel_37, DecimalPlace=Slider(2, range=0..10), RoundType=0)  # -> Rounded, Difference
partition_list_3 = PartitionList(List=merge_23, Size=merge_24)  # -> simplify(Chunks)
subtraction = Subtraction(A=panel_39, B=1)
sort_list = SortList(Keys=subtraction, ValuesValuesA=round_to_decimal_place.Rounded)  # -> Keys, ValuesValuesA
number_slider_32 = Slider(19, range=0..19)
list_length_45 = ListLength(List=subtraction)
partition_list_4 = PartitionList(List=merge_25, Size=merge_26)  # -> simplify(Chunks)
panel_40 = Panel(sort_list.ValuesValuesA)
graft_tree = GraftTree(Tree="Closeness", IncludeEmptyLists=True, IncludeNullItems=True)
list_length_46 = ListLength(List=round_to_decimal_place.Rounded)
panel_41 = Panel(partition_list_3)
series_5 = Series(Start=0, Step=1, Count=list_length_45)
graft_tree_2 = GraftTree(Tree=sort_list.ValuesValuesA, IncludeEmptyLists=True, IncludeNullItems=True)  # -> simplify(Tree)
sort_list_2 = SortList(Keys=subtraction, ValuesValuesA=series_5)  # -> Keys, ValuesValuesA
duplicate_data_4 = DuplicateData(Data=graft_tree, Number=list_length_46, Order=True)  # -> simplify(graft(Data))
list_item_31 = ListItem(List=sort_list_2.ValuesValuesA, Index=number_slider_32, Wrap=True)
number_slider_33 = Slider(9, range=0..10)
number_slider_34 = Slider(11, range=0..100)
text_join = TextJoin(Text=[duplicate_data_4, graft_tree_2], Join="_")
brep_106 = Brep([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])
panel_42 = Panel(sort_list_2.ValuesValuesA)
tree_branch_2 = TreeBranch(Tree=partition_list_3, Path=list_item_31, MaintainPaths=True)
brep_107 = Brep([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])
custom_preview_2 = CustomPreview(Geometry=tree_branch_2, Material=ColourSwatch(SwatchColor=RGB(187, 144, 255)))  # disabled
panel_43 = Panel(text_join)
graft_tree_3 = GraftTree(Tree="Design_option", IncludeEmptyLists=True, IncludeNullItems=True)
panel_44 = Panel(list_item_31)
list_length_47 = ListLength(List=panel_42)
duplicate_data_5 = DuplicateData(Data=brep_107, Number=number_slider_33, Order=True)
duplicate_data_6 = DuplicateData(Data=brep_106, Number=number_slider_34, Order=True)
list_length_48 = ListLength(List=brep_107)
tree_branch_3 = TreeBranch(Tree=partition_list_4, Path=list_item_31, MaintainPaths=True)
list_length_49 = ListLength(List=brep_106)
graft_tree_4 = GraftTree(Tree=panel_42, IncludeEmptyLists=True, IncludeNullItems=True)  # -> simplify(Tree)
custom_preview_3 = CustomPreview(Geometry=brep_57, Material=ColourSwatch(SwatchColor=RGB(95, 232, 105)))  # disabled
number_slider_35 = Slider(4, range=0..10)
duplicate_data_7 = DuplicateData(Data=graft_tree_3, Number=list_length_47, Order=True)  # -> simplify(graft(Data))
text_join_2 = TextJoin(Text=[duplicate_data_7, graft_tree_4], Join="_")
list_item_32 = ListItem(List=flatten(text_join_2), Index=number_slider_32, Wrap=True)
list_item_33 = ListItem(List=flatten(panel_43), Index=number_slider_32, Wrap=True)
unit_z_4 = UnitZ(Factor=expr("x*3", number_slider_35))
text_join_3 = TextJoin(Text=flatten([number_slider_32, "Ranking"]), Join="_")
duplicate_data_8 = DuplicateData(Data=list_length_49, Number=number_slider_34, Order=True)
duplicate_data_9 = DuplicateData(Data=list_length_48, Number=number_slider_33, Order=True)
point_12 = Point(<point referenced from the Rhino model>)
merge_27 = Merge(Data1=duplicate_data_6, Data2=duplicate_data_5)
panel_45 = Panel(text_join_2)
xz_plane = XZPlane(Origin=point_12)
merge_28 = Merge(Data1=list_item_32, Data2=list_item_33, Data4=text_join_3)
list_length_50 = ListLength(List=merge_28)
linear_array = LinearArray(Geometry=xz_plane, Direction=unit_z_4, Count=list_length_50)  # -> Geometry, Transform
merge_29 = Merge(Data1=duplicate_data_8, Data2=duplicate_data_9)
partition_list_5 = PartitionList(List=merge_27, Size=merge_29)  # -> simplify(Chunks)
panel_46 = Panel(merge_28)
colour_swatch = ColourSwatch(SwatchColor=RGB(234, 8, 0))
tree_branch_4 = TreeBranch(Tree=partition_list_5, Path=list_item_31, MaintainPaths=True)
text_tag = TextTag(Location=linear_array.Geometry, Text=merge_28, Colour=colour_swatch)
text_tag_3d = TextTag3D(Location=linear_array.Geometry, Text=merge_28, Size=number_slider_35, Colour=colour_swatch, Justification=7)
custom_preview_4 = CustomPreview(Geometry=tree_branch_4, Material=ColourSwatch(SwatchColor=RGB(249, 200, 97)))  # disabled
