# Grasshopper definition 26022020_Volumetric_design.gh (Grasshopper 1.0.7)
# plug-ins: ExcelReadWrite

path = FilePath("D:\TU_Delft\Msc_Building_Technology\Semester_3\Graduation\Aditya_Graduation_Project_BT\Report\Case\First_Order_Space_Program.xlsx")
# Space Program linked via excel connect
exsread = ExcelStaticRead(ExcelFile=path, Connect=Toggle(True))  # -> Message, Stats, Sheet1
bang = ExplodeTree(Data=exsread.Sheet1)  # -> Branch0, Branch1, Branch2, Branch3, Branch4, Branch5, Branch6, Branch7
cluster = Cluster(I=bang.Branch3)
cluster_2 = Cluster(I=bang.Branch4)
cluster_3 = Cluster(I=bang.Branch2)
cluster_4 = Cluster(I=bang.Branch6)
cluster_5 = Cluster(I=bang.Branch5)
cluster_6 = Cluster(I=bang.Branch1)
cluster_7 = Cluster(I=bang.Branch0)
item = ListItem(List=cluster_4, Index="0", Wrap=True)
cull_i = CullIndex(List=cluster_3, Indices="0", Wrap=True)
cull_i_2 = CullIndex(List=cluster_5, Indices="0", Wrap=True)
cull_i_3 = CullIndex(List=cluster, Indices="0", Wrap=True)
cull_i_4 = CullIndex(List=cluster_6, Indices="0", Wrap=True)
item_2 = ListItem(List=cluster_2, Index="0", Wrap=True)
cull_i_5 = CullIndex(List=cluster_7, Indices="0", Wrap=True)
item_3 = ListItem(List=cull_i_2, Index="0", Wrap=True)
panel = Panel(item)
panel_2 = Panel(item_2)
panel_3 = Panel(item_3)
item_4 = ListItem(List=cull_i, Index="0", Wrap=True)
item_5 = ListItem(List=cull_i_3, Index="0", Wrap=True)
item_6 = ListItem(List=cull_i_5, Index="0", Wrap=True)
item_7 = ListItem(List=cull_i_4, Index="0", Wrap=True)
panel_4 = Panel(item_5)
panel_5 = Panel(item_4)
panel_6 = Panel(item_6)
panel_7 = Panel(item_7)
cull_i_6 = CullIndex(List=cluster_4, Indices="0", Wrap=True)
cull_i_7 = CullIndex(List=cluster_2, Indices="0", Wrap=True)
cull_i_8 = CullIndex(List=cull_i_2, Indices="0", Wrap=True)
panel_8 = Panel(cull_i_6)
cull_i_9 = CullIndex(List=cull_i_3, Indices="0", Wrap=True)
cull_i_10 = CullIndex(List=cull_i, Indices="0", Wrap=True)
panel_9 = Panel(cull_i_8)
cull_i_11 = CullIndex(List=cull_i_4, Indices="0", Wrap=True)
cull_i_12 = CullIndex(List=cull_i_5, Indices="0", Wrap=True)
panel_10 = Panel(cull_i_9)
panel_11 = Panel(cull_i_10)
panel_12 = Panel(cull_i_7)
panel_13 = Panel(cull_i_11)
panel_14 = Panel(cull_i_12)

crv = Curve()

scale_factor = Slider(0.9, range=0..1)
grid_size = Slider(3, range=0..10)

# ----
# Sclaing the site to create the desired Setbacks for development
area = Area(Geometry=crv)  # -> Area, Centroid
scale = Scale(Geometry=crv, Center=area.Centroid, Factor=scale_factor)  # -> Geometry, Transform
crv_2 = Curve(<curve referenced from the Rhino model>)

bbox = BoundingBox(Content=crv, Plane=PlaneXY(0, 0, 0))  # -> Box, Box_2
dim = Dimensions(Surface=bbox.Box)  # -> UDimension, VDimension
# Finding the bounding box and creating a square grid which will encompass the site
division = Division(A=dim.VDimension, B=grid_size)
division_2 = Division(A=dim.UDimension, B=grid_size)
round = Round(Number=division_2)  # -> Nearest, Floor, Ceiling
round_2 = Round(Number=division)  # -> Nearest, Floor, Ceiling
sqgrid = Square(Plane=PlaneXY(0, 0, 0), Size=grid_size, ExtentX=round.Nearest, ExtentY=round_2.Nearest)  # -> Cells, Points
area_2 = Area(Geometry=sqgrid.Cells)  # -> Area, Centroid
incurve = PointInCurve(Point=area_2.Centroid, Curve=scale.Geometry)  # -> Relationship, Point
cull = CullPattern(List=sqgrid.Cells, CullPattern=incurve.Relationship)
area_3 = Area(Geometry=cull)  # -> Area, Centroid
incurve_2 = PointInCurve(Point=area_3.Centroid, Curve=crv_2)  # -> Relationship, Point
toggle = BooleanToggle(True)
cull_2 = CullPattern(List=cull, CullPattern=invert(incurve_2.Relationship))
# Eliminate the grids for the obstacles like roads
number_slider = Slider(3, range=0..10)
clean = CleanTree(RemoveNulls=toggle, RemoveInvalid=toggle, RemoveEmpty=toggle, Tree=cull_2)
area_4 = Area(Geometry=clean)  # -> Area, flatten(Centroid)
explode = Explode(Curve=clean, Recursive=True)  # -> Segments, flatten(Vertices)
series = Series(Start=number_slider, Step=1, Count=Slider(10, range=0..10))
item_8 = ListItem(List=clean, Index=series, Wrap=True)
viewer = ParamViewer(item_8)
series_2 = Series(Start=Slider(5, range=0..10), Step=1, Count=Slider(10, range=0..10))
item_9 = ListItem(List=viewer, Index=series_2, Wrap=True)
branch = TreeBranch(Tree=item_8, Path=item_9, MaintainPaths=True)

item_10 = ListItem(List=cull_i_7, Index="0", Wrap=True)
item_11 = ListItem(List=cull_i_11, Index="0", Wrap=True)

# ----
# Base Profile creation.In this part the oreintation and dimension will be determined
md_slider = MDSlider(
    SliderMode=0,
    slider_value=Point(0.8797346906, 0.4404631824, 0.5),
    x_domain=Domain(0, 1),
    y_domain=Domain(0, 1),
    z_domain=Domain(0, 1))
multiplication = Multiplication(Grid_size=grid_size, MultiplicationFactor=Slider(14, range=0..100))
multiplication_2 = Multiplication(Grid_size=grid_size, MultiplicationFactor=Slider(18, range=0..100))
evalsrf = EvaluateSurface(Surface=reparameterize(scale.Geometry), Point=md_slider)  # -> Point, Normal, UDirection, VDirection, Frame

multiplication_3 = Multiplication(A=item_10, B=item_11)
md_slider_2 = MDSlider(
    SliderMode=0,
    slider_value=Point(0.7798372594, 0.7503187598, 0.5),
    x_domain=Domain(0, 1),
    y_domain=Domain(0, 1),
    z_domain=Domain(0, 1))
md_slider_3 = MDSlider(
    SliderMode=0,
    slider_value=Point(0.1721913407, 0.277705681, 0.5),
    x_domain=Domain(0, 1),
    y_domain=Domain(0, 1),
    z_domain=Domain(0, 1))
md_slider_4 = MDSlider(
    SliderMode=0,
    slider_value=Point(0.7894711378, 0.3330571244, 0.5),
    x_domain=Domain(0, 1),
    y_domain=Domain(0, 1),
    z_domain=Domain(0, 1))
md_slider_5 = MDSlider(
    SliderMode=0,
    slider_value=Point(0.1721905964, 0.6743627409, 0.5),
    x_domain=Domain(0, 1),
    y_domain=Domain(0, 1),
    z_domain=Domain(0, 1))
multiplication_4 = Multiplication(Grid_size=grid_size, MultiplicationFactor=Slider(25, range=0..100))
md_slider_6 = MDSlider(
    SliderMode=0,
    slider_value=Point(0.1072372809, 0.3882193216, 0.5),
    x_domain=Domain(0, 1),
    y_domain=Domain(0, 1),
    z_domain=Domain(0, 1))
division_3 = Division(A=multiplication_3, B=multiplication_4)
multiplication_5 = Multiplication(Grid_size=grid_size, MultiplicationFactor=Slider(22, range=0..100))
multiplication_6 = Multiplication(Grid_size=grid_size, MultiplicationFactor=Slider(22, range=0..100))
multiplication_7 = Multiplication(Grid_size=grid_size, MultiplicationFactor=Slider(11, range=0..100))
multiplication_8 = Multiplication(Grid_size=grid_size, MultiplicationFactor=Slider(22, range=0..100))
multiplication_9 = Multiplication(Grid_size=grid_size, MultiplicationFactor=Slider(11, range=0..100))
multiplication_10 = Multiplication(Grid_size=grid_size, MultiplicationFactor=Slider(22, range=0..100))
multiplication_11 = Multiplication(Grid_size=grid_size, MultiplicationFactor=Slider(11, range=0..100))
multiplication_12 = Multiplication(Grid_size=grid_size, MultiplicationFactor=Slider(11, range=0..100))
evalsrf_2 = EvaluateSurface(Surface=reparameterize(scale.Geometry), Point=md_slider_2)  # -> Point, Normal, UDirection, VDirection, Frame
evalsrf_3 = EvaluateSurface(Surface=reparameterize(scale.Geometry), Point=md_slider_3)  # -> Point, Normal, UDirection, VDirection, Frame
evalsrf_4 = EvaluateSurface(Surface=reparameterize(scale.Geometry), Point=md_slider_4)  # -> Point, Normal, UDirection, VDirection, Frame
evalsrf_5 = EvaluateSurface(Surface=reparameterize(scale.Geometry), Point=md_slider_5)  # -> Point, Normal, UDirection, VDirection, Frame
evalsrf_6 = EvaluateSurface(Surface=reparameterize(scale.Geometry), Point=md_slider_6)  # -> Point, Normal, UDirection, VDirection, Frame
panel_15 = Panel("Total Volume needed")

of_circulation_space = Slider(30, range=0..100)
ma = MassAddition(Input=panel_9)  # -> Result, PartialResults
eval = Evaluate(F="(x*y)/100", x=ma.Result, y=of_circulation_space)
panel_16 = Panel(ma.Result)
panel_17 = Panel(eval)
addition = Addition(A=panel_16, B=panel_17)

number_slider_2 = Slider(15, range=12..23)
cluster_8 = Cluster_2(source=evalsrf_4.Point, length=multiplication_8, breadth=multiplication_11)
cluster_9 = Cluster_2(source=evalsrf_2.Point, length=multiplication_5, breadth=multiplication_7)
cluster_10 = Cluster_2(source=evalsrf_3.Point, length=multiplication_6, breadth=multiplication_9)
cluster_11 = Cluster_2(source=evalsrf_5.Point, length=multiplication_10, breadth=multiplication_12)
cluster_12 = Cluster_2(source=evalsrf_6.Point, length=division_3, breadth=multiplication_4)
# Strategies for Base Shape
panel_18 = Panel("Fix the Location")
panel_19 = Panel("Fix the Size")

number_slider_3 = Slider(0.19, range=0..0.5)
number_slider_4 = Slider(0.1, range=0.1..0.5)
multiplication_13 = Multiplication(A=Slider(3, range=0..10), B=number_slider_2)
division_4 = Division(A="2500", B=multiplication_13)
number_slider_5 = Slider(12, range=0..100)
number_slider_6 = Slider(20, range=0..100)
number_slider_7 = Slider(9, range=0..100)
pt = ConstructPoint(XCoordinate=number_slider_4, YCoordinate=number_slider_3, ZCoordinate=0)
multiplication_14 = Multiplication(Grid_size=grid_size, MultiplicationFactor=number_slider_5)
multiplication_15 = Multiplication(Grid_size=grid_size, MultiplicationFactor=number_slider_6)
multiplication_16 = Multiplication(Grid_size=grid_size, MultiplicationFactor=number_slider_7)
evalsrf_7 = EvaluateSurface(Surface=reparameterize(scale.Geometry), Point=pt)  # -> Point, Normal, UDirection, VDirection, Frame
merge = Merge(Data1=number_slider_5, Data2=number_slider_6, Data3=number_slider_5, Data4=number_slider_6)
cp = ClosestPoint(Point=evalsrf_7.Point, Corners=explode.Vertices)  # -> ClosestPoint, CPIndex, Distance
cluster_13 = Cluster_2(source=cp.ClosestPoint, length=multiplication_13, breadth=division_4)
Z = UnitZ(Factor=multiplication_16)
dup = DuplicateData(Data=number_slider_7, Number="4", Order=True)  # -> graft(Data)
extr = Extrude(Base=cluster_13, Direction=Z)
cap = CapHoles(Brep=extr)
debrep = DeconstructBrep(Brep=cap)  # -> Faces, Edges, Vertices
series_3 = Series(Start=Slider(2, range=0..10), Step=1, Count=Slider(4, range=0..10))
preview = CustomPreview(Geometry=cap, Material=ColourSwatch(SwatchColor=RGB(99, 156, 166)))
item_12 = ListItem(List=debrep.Faces, Index=series_3, Wrap=True)
divide = DivideDomain²(Domain=simplify(graft(item_12)), UCount=simplify(graft(dup)), VCount=simplify(graft(merge)))
subsrf = Isotrim(Surface=graft(item_12), Domain=divide)
area_5 = Area(Geometry=subsrf)  # -> Area, graft(Centroid)

area_6 = Area(Geometry=cluster_8)  # -> Area, Centroid
area_7 = Area(Geometry=cluster_9)  # -> Area, Centroid
area_8 = Area(Geometry=cluster_10)  # -> Area, Centroid
area_9 = Area(Geometry=cluster_11)  # -> Area, Centroid
area_10 = Area(Geometry=cluster_12)  # -> Area, Centroid
panel_20 = Panel(area_10.Area)
panel_21 = Panel("Sun_Path_ Calculation")
division_5 = Division(A=addition, B=Slider(4, range=0..10))
division_6 = Division(A=division_5, B=area_6.Area)
division_7 = Division(A=division_6, B=3)
Z_2 = UnitZ(Factor=division_6)
panel_22 = Panel(division_7)
extr_2 = Extrude(Base=cluster_8, Direction=Z_2)
cap_2 = CapHoles(Brep=extr_2)
division_8 = Division(A=division_5, B=area_7.Area)
Z_3 = UnitZ(Factor=division_8)
extr_3 = Extrude(Base=cluster_9, Direction=Z_3)
division_9 = Division(A=division_5, B=area_8.Area)
Z_4 = UnitZ(Factor=division_9)
extr_4 = Extrude(Base=cluster_10, Direction=Z_4)
division_10 = Division(A=division_5, B=area_9.Area)
Z_5 = UnitZ(Factor=division_10)
extr_5 = Extrude(Base=cluster_11, Direction=Z_5)
cap_3 = CapHoles(Brep=extr_3)
cap_4 = CapHoles(Brep=extr_4)
cap_5 = CapHoles(Brep=extr_5)

pt_2 = Point(Point(-98.08117106, 77.47012983, 0))
pt_3 = Point(Point(-41.93675092, 41.63553114, 0))

panel_23 = Panel("https://www.energyplus.net/weather-download/europe_wmo_region_6/NLD//NLD_Amsterdam.062400_IWEC/all")
series_4 = Series(Start=Slider(7, range=0..10), Step=1, Count=Slider(10, range=0..10))
series_5 = Series(Start=Slider(9, range=0..10), Step=1, Count=Slider(8, range=0..100))
downloadepw = LBDownloadWeather(weather_URL=panel_23)  # -> epw_file, stat_file, ddy_file; plug-in component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
num = Number([9, 10, 11, 12, 1, 2, 3, 4])
hoy = LBCalculateHOY(month=graft(num), day=Slider(1, range=0..1000), hour=series_4)  # -> flatten(hoy), flatten(doy), flatten(date); plug-in component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
importloc = LBImportLocation(epw_file=downloadepw.epw_file)  # -> location; plug-in component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
vec2pt = Vector2Pt(PointA=pt_3, PointB=pt_2, Unitize=False)  # -> Vector, Length
sunpath = LBSunPath(north=vec2pt.Vector, location=importloc, hoys=hoy.hoy, center_pt=area.Centroid, scale=Slider(2, range=0..10))  # -> report, vectors, altitudes, azimuths, hoys, sun_pts, analemma, daily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; plug-in component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
panel_24 = Panel(hoy.hoy)
panel_25 = Panel(sunpath.vectors)

geo = Geometry([Point(202.2174122, 84.4608579, 1.273485219), Point(205.680353, 63.40116625, 11.75436896), Point(203.7925962, 40.88005125, 19.81145307), Point(196.6661782, 18.42572055, 24.48708583), Point(184.7851503, -2.432612121, 25.42293936), Point(168.9581484, -20.27422185, 22.55102763)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])
pt_4 = Point([Point(174.1009589, 123.3919098, 27.32962831), Point(171.8207608, 105.880429, 56.10459976), Point(166.0549885, 87.04612575, 73.74067747), Point(164.1158758, 66.81485498, 81.01308359), Point(165.4152508, 40.29284742, 79.69434922), Point(162.8782369, 7.849523883, 68.22413609)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])
panel_26 = Panel("Reference Barrier")
brep = Brep(<brep referenced from the Rhino model>)
panel_27 = Panel("Solar Access")

ln = Line(StartPoint=area_5.Centroid, EndPoint=sunpath.sun_pts)
shapein = ShapeInBrep(Brep=brep, Shape=ln)
equals = Equality(FirstNumber=shapein, SecondNumber="1")  # -> Equality, Inequality
cull_3 = CullPattern(List=ln, CullPattern=invert(equals.Equality))
lng = ListLength(List=cull_3)  # -> flatten(Length)

panel_28 = Panel("Sound Pressure level")

number_slider_8 = Slider(10, range=0..10)
pt_5 = Point(Point(101.4423698, 153.0281794, 0))
dist = Distance(PointA=area_5.Centroid, PointB=pt_5)
ln_2 = Line(StartPoint=area_5.Centroid, EndPoint=pt_5)
eval_2 = Evaluate(
    F="x-y+(z*log((4*s*k)/a))",
    x=number_slider_8,
    y=number_slider_8,
    z=number_slider_8,
    s=number_slider_8,
    k=number_slider_8,
    a=number_slider_8)
panel_29 = Panel(eval_2)
eval_3 = Evaluate(
    F="(X/2)",
    x=number_slider_8,
    y=number_slider_8,
    z=number_slider_8,
    s=number_slider_8,
    k=number_slider_8,
    a=number_slider_8)

# ----
# Isovist_1
# View to the sea
pt_6 = Point(Point(178.2983658, -9.583831273, 0))
ln_3 = Line(StartPoint=area_5.Centroid, EndPoint=pt_6)
shapein_2 = ShapeInBrep(Brep=brep, Shape=ln_3)
equals_2 = Equality(FirstNumber=shapein_2, SecondNumber="1")  # -> Equality, Inequality
cull_4 = CullPattern(List=ln_3, CullPattern=invert(equals_2.Equality))
lng_2 = ListLength(List=cull_4)  # -> flatten(Length)

# ----
# Isovist_2
# View from the road
pt_7 = Point(Point(216.2747734, 164.9755686, 0))
ln_4 = Line(StartPoint=area_5.Centroid, EndPoint=pt_7)
shapein_3 = ShapeInBrep(Brep=brep, Shape=ln_4)
equals_3 = Equality(FirstNumber=shapein_3, SecondNumber="1")  # -> Equality, Inequality
cull_5 = CullPattern(List=ln_4, CullPattern=invert(equals_3.Equality))
lng_3 = ListLength(List=cull_5)  # -> flatten(Length)

panel_30 = Panel("Optimization ")

galapagos = Galapagos(fitness=ma_2, gene=[number_slider_4, number_slider_3, number_slider_2])
ma_2 = MassAddition(Input=[lng, lng_2, lng_3])  # -> Result, PartialResults

panel_31 = Panel(ma_2.Result)

# ==== cluster Cluster
I = ClusterInput()
null = NullItem(Item=I)  # -> NullFlags, InvalidFlags, Description
cull = CullPattern(List=I, CullPattern=invert(null.NullFlags))
L = ClusterOutput(cull)

# ==== cluster Cluster_2
source = ClusterInput()
length = ClusterInput()
breadth = ClusterInput()
dom = ConstructDomain(DomainStart=expr("x/2", length), DomainEnd=expr("-x/2", length))
dom_2 = ConstructDomain(DomainStart=expr("x/2", breadth), DomainEnd=expr("-x/2", breadth))
rectangle = Rectangle(Plane=source, XSize=dom, YSize=dom_2, Radius=0)  # -> Rectangle, Length
base_rectangle = ClusterOutput(rectangle.Rectangle)
