# Grasshopper definition Unit_Layout_generator.gh (Grasshopper 1.0.7)

series = Series(Start=Slider(3, range=0..100), Step=1, Count=Slider(4, range=0..10))
number_slider = Slider(5, range=0..10)
list_item = ListItem(List=series, Index=Slider(3, range=0..3), Wrap=True)
list_item_2 = ListItem(Index=0, Wrap=True)
subtraction = Subtraction(A=Slider(9, range=0..10), B=list_item)
panel = Panel(list_item)
number_slider_2 = Slider(3, range=0..10)
negative = Negative(Value=Slider(6, range=0..10))
negative_2 = Negative(Value=Slider(4.5, range=0..10))
negative_3 = Negative(Value=Slider(6, range=0..10))
point = Point(<point referenced from the Rhino model>)
point_2 = Point(<point referenced from the Rhino model>)
point_3 = Point(<point referenced from the Rhino model>)
rectangle = Rectangle(Plane=point_3, XSize=Slider(3, range=0..10), YSize=negative_2, Radius=0)  # -> Rectangle, Length
rectangle_2 = Rectangle(Plane=point_2, XSize=Slider(3, range=0..10), YSize=negative, Radius=0)  # -> Rectangle, Length
rectangle_3 = Rectangle(Plane=point, XSize=Slider(3, range=0..10), YSize=negative_3, Radius=0)  # -> Rectangle, Length
negative_4 = Negative(Value=Slider(4, range=0..10))
negative_5 = Negative(Value=subtraction)
negative_6 = Negative(Value=Slider(4, range=0..10))
negative_7 = Negative(Value=Slider(3, range=0..10))
point_4 = Point(<point referenced from the Rhino model>)
surface = Surface(rectangle_2.Rectangle)
point_5 = Point(<point referenced from the Rhino model>)
surface_2 = Surface(rectangle.Rectangle)
point_6 = Point(<point referenced from the Rhino model>)
surface_3 = Surface(rectangle_3.Rectangle)
panel_2 = Panel("""0
1
2
0
2
1
1
0
2
1
2
0
2
0
1
2
1
0""")
number_slider_3 = Slider(2, range=0..10)
point_7 = Point(<point referenced from the Rhino model>)
point_8 = Point(<point referenced from the Rhino model>)
number_slider_4 = Slider(1.5, range=0..10)
rectangle_4 = Rectangle(Plane=point_4, XSize=list_item, YSize=negative_4, Radius=0)  # -> Rectangle, Length
number_slider_5 = Slider(2, range=0..10)
merge = Merge(Data1="253, 255, 182", Data2="202, 255, 191", Data3="160, 196, 255")
rectangle_5 = Rectangle(Plane=point_5, XSize=negative_5, YSize=negative_6, Radius=0)  # -> Rectangle, Length
rectangle_6 = Rectangle(Plane=point_6, XSize=negative_7, YSize=Slider(2, range=0..10), Radius=0)  # -> Rectangle, Length
merge_2 = Merge(Data1=surface, Data2=surface_2, Data3=surface_3)
rectangle_7 = Rectangle(Plane=point_7, XSize=Slider(3, range=0..10), YSize=Slider(2, range=0..10), Radius=0)  # -> Rectangle, Length
rectangle_8 = Rectangle(Plane=point_8, XSize=Slider(2, range=0..10), YSize=Slider(1, range=0..10), Radius=0)  # -> Rectangle, Length
partition_list = PartitionList(List=panel_2, Size=Slider(3, range=0..10))
point_9 = Point(<point referenced from the Rhino model>)
point_10 = Point(<point referenced from the Rhino model>)
curve = Curve(<curve referenced from the Rhino model>)
curve_2 = Curve(<curve referenced from the Rhino model>)
surface_4 = Surface(rectangle_4.Rectangle)
surface_5 = Surface(rectangle_5.Rectangle)
surface_6 = Surface(rectangle_6.Rectangle)
param_viewer = ParamViewer(partition_list)
surface_7 = Surface(rectangle_7.Rectangle)
rectangle_9 = Rectangle(Plane=point_9, XSize=Slider(2, range=0..10), YSize=number_slider_4, Radius=0)  # -> Rectangle, Length
rectangle_10 = Rectangle(Plane=point_10, XSize=Slider(2, range=0..10), YSize=number_slider_4, Radius=0)  # -> Rectangle, Length
surface_8 = Surface(curve_2)
list_item_3 = ListItem(List=param_viewer, Index=Slider(5, range=0..5), Wrap=True)
tree_branch = TreeBranch(Tree=partition_list, Path=list_item_3, MaintainPaths=True)
list_item_4 = ListItem(List=merge, Index=tree_branch, Wrap=True)
custom_preview = CustomPreview(Geometry=merge_2, Material=list_item_4)
surface_9 = Surface(curve)
custom_preview_2 = CustomPreview(Geometry=surface_8, Material="255, 173, 173")
merge_3 = Merge(Data1=surface_4, Data2=surface_5)
custom_preview_3 = CustomPreview(Geometry=surface_7, Material="160, 196, 255")
surface_10 = Surface(rectangle_9.Rectangle)
custom_preview_4 = CustomPreview(Geometry=surface_6, Material="189, 178, 255")
custom_preview_5 = CustomPreview(Geometry=surface_9, Material="255, 255, 235")
panel_3 = Panel("""12
18
6
18
15
15
6
18
15
18
6
15
18
12
6
18
18
15
6
15
18
18
6
12""")
custom_preview_6 = CustomPreview(Geometry=surface_10, Material="189, 178, 255")
merge_4 = Merge(Data1="253, 255, 182", Data2="202, 255, 191")
panel_4 = Panel(list_item_4)
custom_preview_7 = CustomPreview(Geometry=merge_3, Material=reverse(merge_4))
point_11 = Point(<point referenced from the Rhino model>)
partition_list_2 = PartitionList(List=panel_3, Size=Slider(4, range=0..10))
rectangle_11 = Rectangle(Plane=point_11, XSize=Slider(2, range=0..10), YSize=Slider(1.5, range=0..10), Radius=0)  # -> Rectangle, Length
curve_3 = Curve(<curve referenced from the Rhino model>)
number_slider_6 = Slider(3, range=0..10)
panel_5 = Panel(partition_list_2)
surface_11 = Surface(rectangle_11.Rectangle)
surface_12 = Surface(curve_3)
custom_preview_8 = CustomPreview(Geometry=surface_11, Material="255, 173, 173")
custom_preview_9 = CustomPreview(Geometry=surface_12, Material="255, 255, 235")
merge_5 = Merge(Data1=number_slider_6, Data2=number_slider_6, Data3=Slider(2, range=0..10), Data4=number_slider_6)
division = Division(A=partition_list_2, B=merge_5)
panel_6 = Panel("""0
1""")
weave = Weave(Pattern=panel_6, Stream0=division, Stream1=merge_5, NullGaps=False)
panel_7 = Panel(division)
list_item_5 = ListItem(List=division, Index=Slider(2, range=0..10), Wrap=True)
param_viewer_2 = ParamViewer(weave)
list_item_6 = ListItem(List=param_viewer_2, Index=Slider(2, range=0..5), Wrap=True)
panel_8 = Panel(list_item_5)
panel_9 = Panel(weave)
tree_branch_2 = TreeBranch(Tree=weave, Path=list_item_6, MaintainPaths=True)
list_item_7 = ListItem(List=tree_branch_2, Index=0, Wrap=False)  # -> Item, Item1, Item2, Item3, Item4, Item5, Item6, Item7
panel_10 = Panel(tree_branch_2)
panel_11 = Panel(list_item_7.Item6)
