# Grasshopper definition points_green_spaces.gh (Grasshopper 1.0.7)
# plug-ins: ExcelReadWrite

number_slider = Slider(1.4, range=0..10)
number_slider_2 = Slider(1, range=0..100)
unit_z = UnitZ(Factor=1)
construct_point = ConstructPoint(XCoordinate=number_slider, YCoordinate=number_slider, ZCoordinate=number_slider)
brep = Brep([<brep referenced from the Rhino model> x3])
contour = Contour(Shape=brep, Point=construct_point, Direction=unit_z, Distance=Slider(6, range=0..10))
surface = Surface(contour)
divide_surface = DivideSurface(Surface=surface, UCount=Slider(5, range=0..10), VCount=Slider(8, range=0..10))  # -> Points, Normals, Parameters
divide_distance = DivideDistance(Curve=surface, Distance=Slider(3, range=0..10))  # -> Points, Tangents, Parameters
deconstruct = Deconstruct(Point=divide_distance.Points)  # -> XComponent, YComponent, ZComponent
panel = Panel(deconstruct.XComponent)
merge = Merge(Data1=graft(deconstruct.XComponent), Data2=graft(deconstruct.YComponent), Data3=graft(deconstruct.ZComponent))
panel_2 = Panel(merge)
file_path = FilePath("D:\TU_Delft\Msc_Building_Technology\Semester_3\Graduation\Aditya_Graduation_Project_BT\02_Prototyping\Notebooks\Unit_Assignment_problem\Points_of_interest.xlsx")
excelwrite = ExcelWrite(ExcelFile=file_path, Connect=Toggle(True), Sheet1=merge)
