# Grasshopper definition Simulation_script.gh (Grasshopper 1.0.7)
# plug-ins: Kangaroo2 Components

panel = Panel("""210
214
218
222
306
310
314
318
738
742
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""")
panel_3 = Panel("""834
1366
210
214
1798
834
1366
210
218
1798
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​""")
number_slider = Slider(1200, range=0..1200)
number_slider_2 = Slider(52, range=0..488)
number_slider_3 = Slider(0, range=0..56)
number_slider_4 = Slider(6, range=0..10)
number_slider_5 = Slider(830, range=0..5407)
partition_list = PartitionList(List=panel_3, Size=Slider(5, range=0..10))
series = Series(Start=0, Step=1, Count=Slider(500, range=0..1000))
panel_4 = Panel("""8719
8643
8639
8534
8550
8702
8643
8643
8559
8603
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""")
number_slider_6 = Slider(0, range=0..100)
number_slider_7 = Slider(2, range=0..100)
unit_z = UnitZ(Factor=expr("x*2", number_slider_7))
sort_list = SortList(Keys=panel_4, ValuesValuesA=series)  # -> Keys, ValuesValuesA
param_viewer = ParamViewer(partition_list)
path = FilePath(["D:\TU_Delft\Msc_Building_Technology\Semester_3\Graduation\Unit_assignment_problem\Csv_2\abm_f_000.csv", "D:\TU_Delft\Msc_Building_Technology\Semester_3\Graduation\Unit_assignment_problem\Csv_2\abm_f_001.csv", "D:\TU_Delft\Msc_Building_Technology\Semester_3\Graduation\Unit_assignment_problem\Csv_2\abm_f_002.csv", "D:\TU_Delft\Msc_Building_Technology\Semester_3\Graduation\Unit_assignment_problem\Csv_2\abm_f_003.csv", "D:\TU_Delft\Msc_Building_Technology\Semester_3\Graduation\Unit_assignment_problem\Csv_2\abm_f_004.csv", "D:\TU_Delft\Msc_Building_Technology\Semester_3\Graduation\Unit_assignment_problem\Csv_2\abm_f_005.csv"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])
point = Point(<point referenced from the Rhino model>)
linear_array = LinearArray(Geometry=point, Direction=unit_z, Count=Slider(3, range=0..10))  # -> Geometry, Transform
list_length = ListLength(List=panel_4)
number_slider_8 = Slider(0.191, range=0..1)
number_slider_9 = Slider(1, range=0..1)
load_lattice = GhPythonScript(path=path, frame=Slider(761, range=0..761))  # -> out, minbound, unit, shape, lattice; inputs path: list, frame: Int32
# ---------- load_lattice: Python ----------
__author__ = "Shervin Azadi"
__license__ = "MIT"
__version__ = "1.0"
__url__ = "https://github.com/shervinazadi/spatial_computing_workshops"
__summary__ = "Loading Lattice CSV"

import Rhino.Geometry as rg
import csv
import ast

def read_csv(path):
    records = []
    minbound,shape,unit = [],[],[]
    with open(path) as csvfile:
        spamreader = csv.reader(csvfile, delimiter=',', quotechar='|')
        for i, row in enumerate(spamreader):
            if 0 < i < 4:
                vals = [ast.literal_eval(item) for item in row]
                minbound.append(vals[0])
                shape.append(vals[1])
                unit.append(vals[2])
            if i > 5:
                records.append([ast.literal_eval(item) for item in row])
    return (records,minbound,shape,unit)
    
# retrieve results
lattice, minbound, shape, unit = read_csv(path[frame])
# ---------- end load_lattice ----------
panel_5 = Panel(sort_list.ValuesValuesA)
yz_plane = YZPlane(Origin=linear_array.Geometry)
list_length_2 = ListLength(List=panel_5)
series_2 = Series(Start=0, Step=1, Count=number_slider_4)
merge = Merge(
    Data1=ColourSwatch(SwatchColor=RGB(0, 0, 0)),
    Data2=ColourSwatch(SwatchColor=RGB(63, 186, 110)),
    Data3=ColourSwatch(SwatchColor=RGB(235, 108, 108)))
series_3 = Series(Start=0, Step=1, Count=list_length_2)
equality = Equality(FirstNumber=graft(series_2), SecondNumber=panel_5)  # -> Equality, Inequality
cull_pattern = CullPattern(List=series_3, CullPattern=equality.Equality)
list_item = ListItem(List=cull_pattern, Index=number_slider_4, Wrap=True)
list_item_2 = ListItem(List=panel_4, Index=list_item, Wrap=True)
text_join = TextJoin(Text=[list_item, "Iteration"], Join="_")
text_join_2 = TextJoin(Text=["Env_score", list_item_2], Join="=")
list_item_3 = ListItem(List=sort_list.ValuesValuesA, Index=list_item, Wrap=True)
list_item_4 = ListItem(List=param_viewer, Index=list_item, Wrap=True)
text_join_3 = TextJoin(Text=flatten([list_item_3, "Rank"]), Join="=")
merge_2 = Merge(Data1=text_join, Data2=text_join_2, Data3=text_join_3)
text_tag_3d = TextTag3D(Location=yz_plane, Text=merge_2, Size=number_slider_7, Colour=merge, Justification=7)
tree_branch = TreeBranch(Tree=partition_list, Path=list_item_4, MaintainPaths=True)
bouncysolver = BouncySolver(Reset=list_item, Threshold=1e-15, Tolerance=0.01, Damping=0.99, Iterations=10, On=True)  # -> I, V, O
number_slider_10 = Slider(3, range=0..10)
construct_domain = ConstructDomain(DomainStart=expr("x/2", number_slider_10), DomainEnd=expr("-x/2", number_slider_10))
number_slider_11 = Slider(0.6, range=0..1)
lattice_to_points = GhPythonScript(
    minbound=load_lattice.minbound,
    unit=load_lattice.unit,
    shape=load_lattice.shape,
    lattice=load_lattice.lattice,
    low_bound=Slider(9, range=0..10),
    high_bound=Slider(11, range=0..100))  # -> out, points, values; inputs minbound: list, unit: list, shape: list, lattice: list
# ---------- lattice_to_points: Python ----------
__author__ = "Shervin Azadi"
__license__ = "MIT"
__version__ = "1.0"
__url__ = "https://github.com/shervinazadi/spatial_computing_workshops"
__summary__ = "Visualize Lattice CSV"

import Rhino.Geometry as rg

points = []
values = []
for row in lattice:
    if  low_bound <= row[3] <= high_bound:
        point = rg.Point3d(row[0]*unit[0] + minbound[0], row[1]*unit[1] + minbound[1], row[2]*unit[2] + minbound[2])
        points.append(point)
        values.append(row[3])
# ---------- end lattice_to_points ----------
lattice_to_points_2 = GhPythonScript(
    minbound=load_lattice.minbound,
    unit=load_lattice.unit,
    shape=load_lattice.shape,
    lattice=load_lattice.lattice,
    low_bound=Slider(27, range=0..100),
    high_bound=Slider(32, range=0..100))  # -> out, points, values; inputs minbound: list, unit: list, shape: list, lattice: list; same code as lattice_to_points
lattice_to_points_3 = GhPythonScript(
    minbound=load_lattice.minbound,
    unit=load_lattice.unit,
    shape=load_lattice.shape,
    lattice=load_lattice.lattice,
    low_bound=Slider(15, range=0..100),
    high_bound=Slider(21, range=0..100))  # -> out, points, values; inputs minbound: list, unit: list, shape: list, lattice: list; same code as lattice_to_points
domain_box = DomainBox(Base=lattice_to_points.points, X=construct_domain, Y=construct_domain, Z=construct_domain)
domain_box_2 = DomainBox(Base=lattice_to_points_3.points, X=construct_domain, Y=construct_domain, Z=construct_domain)
domain_box_3 = DomainBox(Base=lattice_to_points_2.points, X=construct_domain, Y=construct_domain, Z=construct_domain)
number_slider_12 = Slider(0.1, range=0..1)
create_material = CreateMaterial(Diffuse="255, 173, 173", Specular=RGB(255, 255, 255), Emission=RGB(0, 0, 0), Transparency=number_slider_12, Shine=0)
create_material_2 = CreateMaterial(Diffuse="160, 196, 255", Specular=RGB(255, 255, 255), Emission=RGB(0, 0, 0), Transparency=number_slider_12, Shine=0)
create_material_3 = CreateMaterial(Diffuse="253, 255, 182", Specular=RGB(255, 255, 255), Emission=RGB(0, 0, 0), Transparency=number_slider_12, Shine=0)
mesh_colours = MeshColours(Mesh=domain_box, Colours="255, 173, 173")
mesh_colours_2 = MeshColours(Mesh=domain_box_2, Colours="160, 196, 255")
custom_preview = CustomPreview(Geometry=domain_box, Material=create_material)
mesh_colours_3 = MeshColours(Mesh=domain_box_3, Colours="253, 255, 182")
custom_preview_2 = CustomPreview(Geometry=domain_box_2, Material=create_material_2)
custom_preview_3 = CustomPreview(Geometry=domain_box_3, Material=create_material_3)
