# Grasshopper definition load_lattice_csv.gh (Grasshopper 1.0.7)

path = FilePath(["D:\TU_Delft\Msc_Building_Technology\Semester_3\Graduation\Aditya_Graduation_Project_BT\02_Prototyping\Notebooks\Untitled Folder\csv\abm_f_000.csv", "D:\TU_Delft\Msc_Building_Technology\Semester_3\Graduation\Aditya_Graduation_Project_BT\02_Prototyping\Notebooks\Untitled Folder\csv\abm_f_001.csv", "D:\TU_Delft\Msc_Building_Technology\Semester_3\Graduation\Aditya_Graduation_Project_BT\02_Prototyping\Notebooks\Untitled Folder\csv\abm_f_002.csv", "D:\TU_Delft\Msc_Building_Technology\Semester_3\Graduation\Aditya_Graduation_Project_BT\02_Prototyping\Notebooks\Untitled Folder\csv\abm_f_003.csv", "D:\TU_Delft\Msc_Building_Technology\Semester_3\Graduation\Aditya_Graduation_Project_BT\02_Prototyping\Notebooks\Untitled Folder\csv\abm_f_004.csv", "D:\TU_Delft\Msc_Building_Technology\Semester_3\Graduation\Aditya_Graduation_Project_BT\02_Prototyping\Notebooks\Untitled Folder\csv\abm_f_005.csv"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])
load_lattice = GhPythonScript(path=path, frame=Slider(164, range=0..683))  # -> out, minbound, unit, shape, lattice; inputs path: list, frame: Int32
# ---------- load_lattice: Python ----------
__author__ = "Shervin Azadi"
__license__ = "MIT"
__version__ = "1.0"
__url__ = "https://github.com/shervinazadi/spatial_computing_workshops"
__summary__ = "Loading Lattice CSV"

import Rhino.Geometry as rg
import csv
import ast

def read_csv(path):
    records = []
    minbound,shape,unit = [],[],[]
    with open(path) as csvfile:
        spamreader = csv.reader(csvfile, delimiter=',', quotechar='|')
        for i, row in enumerate(spamreader):
            if 0 < i < 4:
                vals = [ast.literal_eval(item) for item in row]
                minbound.append(vals[0])
                shape.append(vals[1])
                unit.append(vals[2])
            if i > 5:
                records.append([ast.literal_eval(item) for item in row])
    return (records,minbound,shape,unit)
    
# retrieve results
lattice, minbound, shape, unit = read_csv(path[frame])
# ---------- end load_lattice ----------
number_slider = Slider(3, range=0..10)
number_slider_2 = Slider(3, range=0..10)
lattice_to_points = GhPythonScript(
    minbound=load_lattice.minbound,
    unit=load_lattice.unit,
    shape=load_lattice.shape,
    lattice=load_lattice.lattice,
    low_bound=Slider(184, range=0..1000),
    high_bound=Slider(196, range=0..1000))  # -> out, points, values; inputs minbound: list, unit: list, shape: list, lattice: list
# ---------- lattice_to_points: Python ----------
__author__ = "Shervin Azadi"
__license__ = "MIT"
__version__ = "1.0"
__url__ = "https://github.com/shervinazadi/spatial_computing_workshops"
__summary__ = "Visualize Lattice CSV"

import Rhino.Geometry as rg

points = []
values = []
for row in lattice:
    if  low_bound <= row[3] <= high_bound:
        point = rg.Point3d(row[0]*unit[0] + minbound[0], row[1]*unit[1] + minbound[1], row[2]*unit[2] + minbound[2])
        points.append(point)
        values.append(row[3])
# ---------- end lattice_to_points ----------
lattice_to_points_2 = GhPythonScript(
    minbound=load_lattice.minbound,
    unit=load_lattice.unit,
    shape=load_lattice.shape,
    lattice=load_lattice.lattice,
    low_bound=Slider(250, range=0..1000),
    high_bound=Slider(254, range=0..1000))  # -> out, points, values; inputs minbound: list, unit: list, shape: list, lattice: list; same code as lattice_to_points
construct_domain = ConstructDomain(DomainStart=expr("x/2", number_slider), DomainEnd=expr("-x/2", number_slider))
geometry = Geometry(lattice_to_points.points)
panel = Panel(geometry)
construct_domain_2 = ConstructDomain(DomainStart=expr("x/2", number_slider_2), DomainEnd=expr("-x/2", number_slider_2))
domain_box = DomainBox(Base=lattice_to_points.points, X=construct_domain, Y=construct_domain, Z=construct_domain)
domain_box_2 = DomainBox(Base=lattice_to_points_2.points, X=construct_domain_2, Y=construct_domain_2, Z=construct_domain_2)
colour_swatch = ColourSwatch(SwatchColor=RGB(240, 211, 211))
colour_swatch_2 = ColourSwatch(SwatchColor=RGB(157, 212, 152))
create_material = CreateMaterial(Diffuse=colour_swatch_2, Specular=colour_swatch_2, Emission=RGB(0, 0, 0), Transparency=Slider(0.3, range=0..1), Shine=0)
custom_preview = CustomPreview(Geometry=domain_box_2, Material=create_material)
create_material_2 = CreateMaterial(Diffuse=colour_swatch, Specular=colour_swatch, Emission=RGB(0, 0, 0), Transparency=Slider(0.3, range=0..1), Shine=0)
custom_preview_2 = CustomPreview(Geometry=domain_box, Material=create_material_2)
